vi "Create Resources.gvi"   [LabVIEW Communications System Design Suite 2.0.1]
# Creates and initializes resources for the instrument design libraries.
# Output Parameters
# config.resources contains references to the configuration registers.
# sync.resources contains references to the synchronization registers.
# time.resources contains references to the time registers.
outputs:
  "sync.resources": "niUsrpRio Synchronization v1 FPGA.lvlib__Resources.gtype"
  "config.resources": T1
  "time.resources": T2
types:
  T1 = cluster{"DAC FIFO Reset": RegisterDataType<bool>, "RF 0 Rx Swap IQ": RegisterDataType<bool>, "RF 0 Rx Negate I": RegisterDataType<bool>, "RF 0 Rx Negate Q": RegisterDataType<bool>, "RF 0 Rx Data Valid": RegisterDataType<bool>, "RF 0 Rx Data Ever Invalid": RegisterDataType<bool>, "clear RF 0 Rx Data Ever Invalid": RegisterDataType<bool>, "RF 0 Tx Swap IQ": RegisterDataType<bool>, "RF 0 Tx Negate I": RegisterDataType<bool>, "RF 0 Tx Negate Q": RegisterDataType<bool>, "RF 1 Rx Swap IQ": RegisterDataType<bool>, "RF 1 Rx Negate I": RegisterDataType<bool>, "RF 1 Rx Negate Q": RegisterDataType<bool>, "RF 1 Rx Data Valid": RegisterDataType<bool>, "RF 1 Rx Data Ever Invalid": RegisterDataType<bool>, "clear RF 1 Rx Data Ever Invalid": RegisterDataType<bool>, "RF 1 Tx Swap IQ": RegisterDataType<bool>, "RF 1 Tx Negate I": RegisterDataType<bool>, "RF 1 Tx Negate Q": RegisterDataType<bool>}
  "niUsrpRio Synchronization v1 FPGA.lvlib__Resources.gtype" = cluster{"master": RegisterDataType<bool>, "meas.enable": RegisterDataType<bool>, "meas.ready": RegisterDataType<bool>, "meas.reset": RegisterDataType<bool>, "meas.arm": RegisterDataType<bool>, "meas.valid": RegisterDataType<bool>, "meas.value": RegisterDataType<u16>, "meas.oversample factor": RegisterDataType<u16>, "cptr": RegisterDataType<bool>, "cptr.adjust": RegisterDataType<u16>, "cptr.period": RegisterDataType<u16>}
  "niUsrpRio Time v1 FPGA.lvlib__Time Resources.gtype" = cluster{"reset": RegisterDataType<bool>, "time": RegisterDataType<u64>, "time.previous cptr": RegisterDataType<u64>, "new time": RegisterDataType<u64>, "new time.when": RegisterDataType<u8>, "new time.set": RegisterDataType<bool>, "which edge of ref": RegisterDataType<bool>, "pps source": RegisterDataType<u8>, "internal pps period": RegisterDataType<u32>, "time 2": RegisterDataType<u64>}
  "niUsrpRio Time v1 FPGA.lvlib__Future Event Resources.gtype" = cluster{"reset": RegisterDataType<bool>, "future event.time": RegisterDataType<u64>, "future event.ready": RegisterDataType<bool>, "future event.set": RegisterDataType<bool>, "future event.clear": RegisterDataType<bool>, "future event.set in past": RegisterDataType<bool>}
  T2 = cluster{"time.resources": "niUsrpRio Time v1 FPGA.lvlib__Time Resources.gtype", "future event.resources": "niUsrpRio Time v1 FPGA.lvlib__Future Event Resources.gtype", "future event.resources_2": "niUsrpRio Time v1 FPGA.lvlib__Future Event Resources.gtype"}
diagram:
  call "niUsrpRio Config v1 FPGA.lvlib__Create.gvi"() -> (resources=w1)
  $"config.resources" <- w1
  call "niUsrpRio Synchronization v1 FPGA.lvlib__Create.gvi"() -> (sync.resources=w2)
  $"sync.resources" <- w2
  call "niUsrpRio Time v1 FPGA.lvlib__Create Time.gvi"() -> (time.resources=w3)
  call "niUsrpRio Time v1 FPGA.lvlib__Create Future Event.gvi"() -> (future event.resources=w4)
  call "niUsrpRio Time v1 FPGA.lvlib__Create Future Event.gvi"() -> (future event.resources=w5)
  Property Node(instance in=T2 {all zero or empty}, "time.resources"=w3, "future event.resources"=w4, "future event.resources_2"=w5) -> (instance out=w6)
  $"time.resources" <- w6
