vi "CalibrateLevel.gvi"   [LabVIEW Communications System Design Suite 2.0.1]
inputs:
  "coerced gain": f64
outputs:
  "Numeric": f64
diagram:
  # Calibrate level : Estimate the calibration level for USRP
  Divide(x=$"coerced gain", y=10) -> w1
  Power Of 10(x=w1) -> w2
  Divide(x=w2, y=10) -> w3
  Square Root(x=w3) -> w4
  Divide(x=w4, y=65536) -> w5
  Multiply(w5, 2) -> w6
  $Numeric <- w6
