vi "DC Removal.gvi"   [LabVIEW Communications System Design Suite 2.0.1]
inputs:
  "appended array": c128[]
  "En": bool
outputs:
  "x": c128[]
diagram:
  case ($En) {
    frame False, Default {
      w1 = $"appended array"
    }
    frame True {
      Complex To Real Imaginary(x + iy=$"appended array") -> (x=w2, y=w3)
      Array Size(array=w2) -> (size(s)=w4)
      Add Array Elements(numeric array=w2) -> (sum=w5)
      Divide(x=w5, y=w4) -> w6
      Subtract(x=w2, y=w6) -> w7
      Add Array Elements(numeric array=w3) -> (sum=w8)
      Divide(x=w8, y=w4) -> w9
      Subtract(x=w3, y=w9) -> w10
      Real And Imaginary To Complex(x=w7, y=w10) -> w1
    }
  }
  $x <- w1
