vi "Estimate Tx To Rx delay.gvi"   [LabVIEW Communications System Design Suite 2.0.1]
inputs:
  "Search len": u32 = 1000
  "Conv win len": i32 = 3000
  "Rx": c128[]
  "Tx": c128[]
  "En": bool
outputs:
  "BBTX-BBRX Delay": i32
diagram:
  case ($En) {
    frame False, Default {
      w1 = 100000
    }
    frame True {
      s1 = 0  # shift register
      s2 = 0  # shift register
      for (N = $"Search len") (iteration -> i1) {
        # To estimate the deay between BBRx and BBTx
        Array Subset(array=$Tx, index0=0, length0=$"Conv win len") -> w2
        Array Subset(array=$Rx, index0=i1, length0=$"Conv win len") -> w3
        Multiply(w2, w3) -> w4
        Add Array Elements(numeric array=w4) -> (sum=w5)
        Absolute Value(x=w5) -> w6
        Array Subset(array=$Rx, index0=0) -> w7
        Array Subset(array=$Tx, index0=i1, length0=$"Conv win len") -> w8
        Multiply(w7, w8) -> w9
        Add Array Elements(numeric array=w9) -> (sum=w10)
        Absolute Value(x=w10) -> w11
        Is Greater(x=w6, y=w11) -> w12
        Select(s=w12, t=w6, f=w11) -> w13
        Is Greater(x=w13, y=s1) -> w14
        Select(s=w12, t=1, f=-1) -> w15
        case (w14) {
          frame False, Default {
            w16 = s1
            w17 = s2
          }
          frame True {
            Multiply(i1, w15) -> w17
            w16 = w13
          }
        }
        next s1 = w16
        next s2 = w17
      }
      w1 = s2
    }
  }
  $"BBTX-BBRX Delay" <- w1
