vi "Power Spectrum.gvi"   [LabVIEW Communications System Design Suite 2.0.1]
inputs:
  "N": u32
  "data IQ": u32[]
  "Calibration": f64
outputs:
  "Inband power": f64
  "Spectrum": f64[]
panel indicators:
  "Graph_Rx Spectrum": T1
  "Graph_Rx Spectrum_2": T1
types:
  T1 = cluster{"f0": f64, "df": f64, "magnitude": f64[]}
uses:
  NI::Analysis::Measurement::Power Spectrum (CDB).gvi
  NI::Analysis::Transforms::Complex FFT.gvi
diagram:
  # Read IQ baseband data
  Split Number(x=$"data IQ") -> (high(x)=w1, low(x)=w2)
  To Word Integer(number=w1) -> w3
  To Word Integer(number=w2) -> w4
  Real And Imaginary To Complex(x=w3, y=w4) -> w5
  Multiply(w5, $Calibration) -> w6
  Absolute Value(x=w6) -> w7
  Square(x=w7) -> w8
  Add Array Elements(numeric array=w8) -> (sum=w9)
  Divide(x=w9, y=$N) -> w10
  Multiply(w10, 10) -> w11
  Logarithm Base 10(x=w11) -> w12
  Multiply(w12, 10) -> w13
  $"Inband power" <- w13
  Divide(x=$N, y=2) -> w14
  To Long Integer(number=w14) -> w15
  disable {
    frame Enabled { }
    frame Disabled {
      call "Power Spectrum (CDB).gvi"(signal=w6) -> (power spectrum=w16)
      Rotate 1D Array(array=w16, n=w15) -> (array (last n elements first)=w17)
      Multiply(w17, 10) -> w18
      Logarithm Base 10(x=w18) -> w19
      Multiply(w19, 10) -> w20
      Property Node(instance in=T1 {"f0"=-8000000, "df"=16000, "magnitude"=[]}, "magnitude"=w20) -> (instance out=w21)
      $"Graph_Rx Spectrum_2" <- w21
    }
  }
  Array Size(array=w6) -> (size(s)=w22)
  call "Complex FFT.gvi"(x=w6, FFT size=w22) -> (FFT{x}=w23)
  Rotate 1D Array(array=w23, n=w15) -> (array (last n elements first)=w24)
  Absolute Value(x=w24) -> w25
  Square(x=w25) -> w26
  Divide(x=w26, y=w22) -> w27
  Multiply(w27, 0.01) -> w28
  Logarithm Base 10(x=w28) -> w29
  Multiply(w29, 10) -> w30
  $Spectrum <- w30
  Property Node(instance in=T1 {"f0"=-8000000, "df"=16000, "magnitude"=[]}, "magnitude"=w30) -> (instance out=w31)
  $"Graph_Rx Spectrum" <- w31
