vi "Abort Stream.gvi"   [LabVIEW NXG]
inputs:
  "niUsrpRio Session": T7 = {"EEPROM Header"={"Number of Reserved Bytes"=9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}, "Device Data Header"={"Number of Reserved Bytes"=27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}, "EEPROM Characterization Header"={"Number of Reserved Bytes"=28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}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}
  "timeout": f64 = 10
  "error in": error
  "scope": string = "rx"
outputs:
  "niUsrpRio Session (out)": T7
  "error out": error
panel controls:
  "ConstantData2": any
panel indicators:
  "state": enum{"Idle", "Active"}
  "samples processed": u32
types:
  T1 = cluster{"fpga ref": any, "bus instance": u32, "instruction FIFO depth": u32, "executing on FPGA target": bool, "show error call chain": bool}
  T2 = cluster{"Checksum": u32, "Product Code": u16, "Hardware Current Version": u16, "Hardware Oldest Compatible Version": u16, "EEPROM Map Current Version": u16, "EEPROM Map Oldest Compatible Version": u16, "User Password": string, "Pointer to Factory Header": u32, "Pointer to User Header": u32, "Recommended Interval": u16, "Number of Reserved Bytes": i32, "Number of Daughterboards": u8, "Daughterboard IDs": u16[], "Daughterboard Serial Numbers": string[]}
  T3 = cluster{"Checksum": u32, "Number of Channels": u8, "Number of Gain Settings": u16[], "Pointer to Characterization Data": u32[], "Number of Reserved Bytes": i32, "Number of Frequencies": u16[]}
  T4 = cluster{"Checksum": u32, "Date": timestamp, "Temperature": f32, "Misc. Info": string, "Pointer to Device Data Header": u32, "Number of Reserved Bytes": i32}
  T5 = cluster{"Gain Imbalance [linear]": f64, "Phase Imbalance [radians]": f64, "Offset": c128}
  T6 = cluster{"Gains[dB]": f64[], "Frequencies [Hz]": f64[], "IQ Imbalance Table": T5[], "Measured Gains[dB]": f64[][]}
  T7 = cluster{"Global Settings Register Bus": Queue<T1>, "Radio 0 Settings Register Bus": Queue<T1>, "Rx NI-USRP session": niUSRP, "Tx NI-USRP session": niUSRP, "FPGA Interface": any, "RIO Interface Number": u32, "EEPROM Header": T2, "Device Data Header": T3, "EEPROM Characterization Header": T4, "Characterization Data": T6[], "Characterization Data Valid?": bool, "Radio 1 Settings Register Bus": Queue<T1>, "Radio Settings Bus Semaphore": i32, "FPGA Current Version": u32, "FPGA Oldest Compatible Version": u32, "Fixed Logic Current Version": u32, "Fixed Logic Oldest Compatible Version": u32, "FPGA Radio Settings Bus Current Version": u32, "FPGA Radio Settings Bus Oldest Compatible Version": u32}
diagram:
  call "niUsrpRio Config v1 Host.lvlib__Parse Scope.gvi"(niUsrpRio Session=$"niUsrpRio Session", Error In=$"error in", scope=$scope) -> (niUsrpRio Session (out)=w1, Device Subfunction=w2, Error Out=w3)
  Property Node(instance in=w1) -> ("FPGA Interface"=w4)
  Dynamic Fpga Interface Cast(FPGA VI Reference In=w4, Type=$ConstantData2) -> (FPGA VI Reference Out=w5)
  case (w2) {
    frame "tx" {
      Property Node(instance in=w5, error in=w3, "tx.abort"=TRUE, "tx.enable trigger"=FALSE) -> (instance out=w10, error out=w11)
      s1 = w11  # shift register
      while (iteration -> i1) {
        Property Node(instance in=w10, error in=s1) -> (error out=w12, "tx.samples processed"=w9, "tx.state"=w7)
        Is Equal To 0(x=i1) -> w13
        call "Elapsed Time.gvi"(Time Target (s)=$timeout, Reset=w13) -> (Time has Elapsed=w14)
        Is Equal(x=w7, y="Idle") -> w8
        Logical Or(w12, w8, w14) -> w15
        next s1 = w12
        stop if w15
      }
      w6 = s1
    }
    frame "rx", Default {
      Property Node(instance in=w5, error in=w3, "rx.abort"=TRUE, "rx.enable trigger"=FALSE) -> (instance out=w16, error out=w17)
      s2 = w17  # shift register
      while (iteration -> i2) {
        Property Node(instance in=w16, error in=s2) -> (error out=w18, "rx.samples processed"=w9, "rx.state"=w7)
        Is Equal To 0(x=i2) -> w19
        call "Elapsed Time.gvi"(Time Target (s)=$timeout, Reset=w19) -> (Time has Elapsed=w20)
        Is Equal(x=w7, y="Idle") -> w8
        Logical Or(w18, w8, w20) -> w21
        next s2 = w18
        stop if w21
      }
      w6 = s2
    }
  }
  case (w8) {
    frame True {
      w22 = w6
    }
    frame False {
      call "Error Cluster From Error Code.gvi"(error code (0)=-1, error message ("")="Abort Timeout", show call chain? (False)=TRUE) -> (Error Out=w23)
      Merge Errors(w6, w23) -> (error out=w22)
    }
  }
  call "Check Stream Status.gvi"(niUsrpRio Session=w1, error in=w22, scope=$scope) -> (niUsrpRio Session (out)=w24, error out=w25)
  $"niUsrpRio Session (out)" <- w24
  $"error out" <- w25
  $"samples processed" <- w9
  $state <- w7
