vi "Calculate IQ Power Level.gvi"   [LabVIEW NXG]
inputs:
  "IQ data": c128[]
outputs:
  "power level (dBm)": f64[]
diagram:
  Complex To Real Imaginary(x + iy=$"IQ data") -> (x=w1, y=w2)
  Square(x=w1) -> w3
  Square(x=w2) -> w4
  Add(w3, w4) -> w5
  Multiply(w5, 10) -> w6
  Logarithm Base 10(x=w6) -> w7
  Multiply(w7, 10) -> w8
  $"power level (dBm)" <- w8
