vi "Calculate Power Spectrum.gvi"   [LabVIEW NXG]
inputs:
  "IQ Waveform": cluster{"t0": timestamp, "dt": f64, "Y": c128[]}
outputs:
  "power spectrum (dBm)": T1
types:
  T1 = cluster{"f0": f64, "df": f64, "magnitude": f64[]}
  T2 = enum{"No averaging", "Vector averaging", "RMS averaging", "Peak hold"}
  T3 = cluster{"averaging mode": T2, "weighting mode": enum{"Linear", "Exponential"}, "number of averages": u32}
diagram:
  w1 = T3 {"averaging mode"="No averaging", "weighting mode"="Exponential", "number of averages"=10}
  call "NI_MAPro.lvlib__FFT Power Spectrum and PSD for 1 Chan (CDB).gvi"(time signal=$"IQ Waveform", averaging parameters=w1) -> (Power Spectrum / PSD=w2)
  Property Node(instance in=w2) -> ("magnitude"=w3)
  Multiply(w3, 10) -> w4
  Logarithm Base 10(x=w4) -> w5
  Multiply(w5, 10) -> w6
  Property Node(instance in=w2, "magnitude"=w6) -> (instance out=w7)
  $"power spectrum (dBm)" <- w7
