vi "Check Stream Status.gvi"   [LabVIEW NXG]
inputs:
  "niUsrpRio Session": T7 = {"EEPROM Header"={"Number of Reserved Bytes"=9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}, "Device Data Header"={"Number of Reserved Bytes"=27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}, "EEPROM Characterization Header"={"Number of Reserved Bytes"=28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}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}
  "error in": error
  "scope": string = "rx"
  "reference frequency source": string = "Internal"
outputs:
  "niUsrpRio Session (out)": T7
  "done": bool
  "error out": error
panel controls:
  "ConstantData7": any
types:
  T1 = cluster{"fpga ref": any, "bus instance": u32, "instruction FIFO depth": u32, "executing on FPGA target": bool, "show error call chain": bool}
  T2 = cluster{"Checksum": u32, "Product Code": u16, "Hardware Current Version": u16, "Hardware Oldest Compatible Version": u16, "EEPROM Map Current Version": u16, "EEPROM Map Oldest Compatible Version": u16, "User Password": string, "Pointer to Factory Header": u32, "Pointer to User Header": u32, "Recommended Interval": u16, "Number of Reserved Bytes": i32, "Number of Daughterboards": u8, "Daughterboard IDs": u16[], "Daughterboard Serial Numbers": string[]}
  T3 = cluster{"Checksum": u32, "Number of Channels": u8, "Number of Gain Settings": u16[], "Pointer to Characterization Data": u32[], "Number of Reserved Bytes": i32, "Number of Frequencies": u16[]}
  T4 = cluster{"Checksum": u32, "Date": timestamp, "Temperature": f32, "Misc. Info": string, "Pointer to Device Data Header": u32, "Number of Reserved Bytes": i32}
  T5 = cluster{"Gain Imbalance [linear]": f64, "Phase Imbalance [radians]": f64, "Offset": c128}
  T6 = cluster{"Gains[dB]": f64[], "Frequencies [Hz]": f64[], "IQ Imbalance Table": T5[], "Measured Gains[dB]": f64[][]}
  T7 = cluster{"Global Settings Register Bus": Queue<T1>, "Radio 0 Settings Register Bus": Queue<T1>, "Rx NI-USRP session": niUSRP, "Tx NI-USRP session": niUSRP, "FPGA Interface": any, "RIO Interface Number": u32, "EEPROM Header": T2, "Device Data Header": T3, "EEPROM Characterization Header": T4, "Characterization Data": T6[], "Characterization Data Valid?": bool, "Radio 1 Settings Register Bus": Queue<T1>, "Radio Settings Bus Semaphore": i32, "FPGA Current Version": u32, "FPGA Oldest Compatible Version": u32, "Fixed Logic Current Version": u32, "Fixed Logic Oldest Compatible Version": u32, "FPGA Radio Settings Bus Current Version": u32, "FPGA Radio Settings Bus Oldest Compatible Version": u32}
diagram:
  call "niUsrpRio Config v1 Host.lvlib__Query Status.gvi"(niUsrpRio Session=$"niUsrpRio Session", What to Query for="Clock Chip Ever Unlocked", Error In=$"error in", scope=$scope) -> (niUsrpRio Session (out)=w1, Status=w2, Error Out=w3)
  case (w2) {
    frame False {
      w4 = w3
    }
    frame True {
      call "Error Cluster From Error Code.gvi"(error code (0)=1, error message ("")="Clock chip became unlocked", show call chain? (False)=TRUE, is warning? (False)=TRUE) -> (Error Out=w5)
      Merge Errors(w3, w5) -> (error out=w4)
    }
  }
  case ($"reference frequency source") {
    frame Default {
      w6 = w1
      w7 = w4
    }
    frame "GPS" {
      call "niUsrpRio Config v1 Host.lvlib__Query Status.gvi"(niUsrpRio Session=w1, What to Query for="GPS Ever Unlocked", Error In=w4, scope=$scope) -> (niUsrpRio Session (out)=w6, Status=w8, Error Out=w9)
      case (w8) {
        frame False {
          w7 = w9
        }
        frame True {
          call "Error Cluster From Error Code.gvi"(error code (0)=1, error message ("")="GPS became unlocked", show call chain? (False)=TRUE, is warning? (False)=TRUE) -> (Error Out=w10)
          Merge Errors(w9, w10) -> (error out=w7)
        }
      }
    }
  }
  call "niUsrpRio Config v1 Host.lvlib__Parse Scope.gvi"(niUsrpRio Session=w6, Error In=w7, scope=$scope) -> (niUsrpRio Session (out)=w11, Device Subfunction=w12, Device Subfunction Channel=w13, Error Out=w14)
  $"niUsrpRio Session (out)" <- w11
  Property Node(instance in=w11) -> ("FPGA Interface"=w15)
  Dynamic Fpga Interface Cast(FPGA VI Reference In=w15, Type=$ConstantData7) -> (FPGA VI Reference Out=w16)
  case (w12) {
    frame "tx" {
      Property Node(instance in=w16, error in=w14) -> (error out=w18, "tx.underflows"=w17, "tx 0.number of IQ data overflows"=w19, "tx 1.number of IQ data overflows"=w20, "tx.state"=w21, "tx.samples processed"=w22, "tx.samples to generate"=w23)
      w24 = "Tx FIFO Underflows (%d)"
    }
    frame "rx", Default {
      Property Node(instance in=w16, error in=w14) -> (error out=w18, "rx.number of overflows"=w17, "rx 0.number of IQ data overflows"=w19, "rx 1.number of IQ data overflows"=w20, "rx.state"=w21, "rx.samples processed"=w22, "rx.samples to acquire"=w23)
      w24 = "Rx FIFO Overflows (%d)"
    }
  }
  case (w17) {
    frame 0 {
      w25 = w18
    }
    frame Default {
      Format Into String(formatString=w24, w17) -> w26
      call "Error Cluster From Error Code.gvi"(error code (0)=1, error message ("")=w26, show call chain? (False)=TRUE, is warning? (False)=TRUE) -> (Error Out=w27)
      Merge Errors(w18, w27) -> (error out=w25)
    }
  }
  case (w13) {
    frame "0", Default {
      w28 = w19
    }
    frame "1" {
      w28 = w20
    }
    frame "All" {
      Add(w19, w20) -> w28
    }
  }
  case (w28) {
    frame 0 {
      w29 = w25
    }
    frame Default {
      call "Error Cluster From Error Code.gvi"(error code (0)=1, error message ("")="DSP Overflow", show call chain? (False)=TRUE, is warning? (False)=TRUE) -> (Error Out=w30)
      Merge Errors(w25, w30) -> (error out=w29)
    }
  }
  $"error out" <- w29
  Is Equal(x="Idle", y=w21) -> w31
  Is Equal(x=w22, y=w23) -> w32
  Logical And(w31, w32) -> w33
  $done <- w33
