vi "Configure Frequency.gvi"   [LabVIEW NXG]
inputs:
  "niUsrpRio Session": T7 = {"EEPROM Header"={"Number of Reserved Bytes"=9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}, "Device Data Header"={"Number of Reserved Bytes"=27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}, "EEPROM Characterization Header"={"Number of Reserved Bytes"=28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}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}
  "wait for lo to lock": bool = TRUE
  "lo frequency": f64 = -1
  "frequency": f64 = 2450000000
  "error in": error
  "scope": string = "rx"
outputs:
  "niUsrpRio Session (out)": T7
  "coerced lo frequency": f64
  "error out": error
types:
  T1 = cluster{"fpga ref": any, "bus instance": u32, "instruction FIFO depth": u32, "executing on FPGA target": bool, "show error call chain": bool}
  T2 = cluster{"Checksum": u32, "Product Code": u16, "Hardware Current Version": u16, "Hardware Oldest Compatible Version": u16, "EEPROM Map Current Version": u16, "EEPROM Map Oldest Compatible Version": u16, "User Password": string, "Pointer to Factory Header": u32, "Pointer to User Header": u32, "Recommended Interval": u16, "Number of Reserved Bytes": i32, "Number of Daughterboards": u8, "Daughterboard IDs": u16[], "Daughterboard Serial Numbers": string[]}
  T3 = cluster{"Checksum": u32, "Number of Channels": u8, "Number of Gain Settings": u16[], "Pointer to Characterization Data": u32[], "Number of Reserved Bytes": i32, "Number of Frequencies": u16[]}
  T4 = cluster{"Checksum": u32, "Date": timestamp, "Temperature": f32, "Misc. Info": string, "Pointer to Device Data Header": u32, "Number of Reserved Bytes": i32}
  T5 = cluster{"Gain Imbalance [linear]": f64, "Phase Imbalance [radians]": f64, "Offset": c128}
  T6 = cluster{"Gains[dB]": f64[], "Frequencies [Hz]": f64[], "IQ Imbalance Table": T5[], "Measured Gains[dB]": f64[][]}
  T7 = cluster{"Global Settings Register Bus": Queue<T1>, "Radio 0 Settings Register Bus": Queue<T1>, "Rx NI-USRP session": niUSRP, "Tx NI-USRP session": niUSRP, "FPGA Interface": any, "RIO Interface Number": u32, "EEPROM Header": T2, "Device Data Header": T3, "EEPROM Characterization Header": T4, "Characterization Data": T6[], "Characterization Data Valid?": bool, "Radio 1 Settings Register Bus": Queue<T1>, "Radio Settings Bus Semaphore": i32, "FPGA Current Version": u32, "FPGA Oldest Compatible Version": u32, "Fixed Logic Current Version": u32, "Fixed Logic Oldest Compatible Version": u32, "FPGA Radio Settings Bus Current Version": u32, "FPGA Radio Settings Bus Oldest Compatible Version": u32}
diagram:
  case ($"lo frequency") {
    frame Default {
      w1 = $"lo frequency"
    }
    frame -1 {
      w1 = $frequency
    }
  }
  call "niUsrpRio Config v1 Host.lvlib__Enable Front End.gvi"(niUsrpRio Session=$"niUsrpRio Session", enable=TRUE, error in=$"error in", scope=$scope) -> (niUsrpRio Session (out)=w2, error out=w3)
  call "niUsrpRio Config v1 Host.lvlib__Configure LO.gvi"(niUsrpRio session=w2, frequency (Hz)=w1, Error In=w3, scope=$scope) -> (niUsrpRio session (out)=w4, coerced frequency (Hz)=w5, Error Out=w6)
  Subtract(x=$frequency, y=w5) -> w7
  case ($"wait for lo to lock") {
    frame False, Default {
      w8 = w6
      w9 = w4
    }
    frame True {
      call "niUsrpRio Config v1 Host.lvlib__Wait until Done.gvi"(niUsrpRio Session=w4, What to Wait for="LO Locked", timeout=10, Error In=w6, scope=$scope) -> (niUsrpRio Session (out)=w9, Error Out=w8)
    }
  }
  call "Configure Frequency Shift.gvi"(niUsrpRio session=w9, clock rate=120000000, frequency shift=w7, error in=w8, scope=$scope) -> (niUsrpRio Session (out)=w10, error out=w11)
  $"niUsrpRio Session (out)" <- w10
  $"error out" <- w11
  $"coerced lo frequency" <- w5
