vi "Configure Signal (Level).gvi"   [LabVIEW NXG]
inputs:
  "niUsrpRio Session": T7 = {"EEPROM Header"={"Number of Reserved Bytes"=9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}, "Device Data Header"={"Number of Reserved Bytes"=27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}, "EEPROM Characterization Header"={"Number of Reserved Bytes"=28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}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}
  "sample rate [S/s]": f64 = 10000000
  "frequency [Hz]": f64 = 2450000000
  "level [dBm]": f64 = -10
  "error in": error
  "scope": string = "rx"
  "Correct Impairments?": bool = TRUE
  "Active Antenna": string = "RX1"
  "LO frequency [Hz]": f64 = -1
outputs:
  "niUsrpRio Session (out)": T7
  "coerced sample rate [S/s]": f64
  "coerced frequency [Hz]": f64
  "coerced level [dBm]": f64
  "error out": error
  "coerced vertical range [Vpp]": f64
  "coerced LO frequency [Hz]": f64
types:
  T1 = cluster{"fpga ref": any, "bus instance": u32, "instruction FIFO depth": u32, "executing on FPGA target": bool, "show error call chain": bool}
  T2 = cluster{"Checksum": u32, "Product Code": u16, "Hardware Current Version": u16, "Hardware Oldest Compatible Version": u16, "EEPROM Map Current Version": u16, "EEPROM Map Oldest Compatible Version": u16, "User Password": string, "Pointer to Factory Header": u32, "Pointer to User Header": u32, "Recommended Interval": u16, "Number of Reserved Bytes": i32, "Number of Daughterboards": u8, "Daughterboard IDs": u16[], "Daughterboard Serial Numbers": string[]}
  T3 = cluster{"Checksum": u32, "Number of Channels": u8, "Number of Gain Settings": u16[], "Pointer to Characterization Data": u32[], "Number of Reserved Bytes": i32, "Number of Frequencies": u16[]}
  T4 = cluster{"Checksum": u32, "Date": timestamp, "Temperature": f32, "Misc. Info": string, "Pointer to Device Data Header": u32, "Number of Reserved Bytes": i32}
  T5 = cluster{"Gain Imbalance [linear]": f64, "Phase Imbalance [radians]": f64, "Offset": c128}
  T6 = cluster{"Gains[dB]": f64[], "Frequencies [Hz]": f64[], "IQ Imbalance Table": T5[], "Measured Gains[dB]": f64[][]}
  T7 = cluster{"Global Settings Register Bus": Queue<T1>, "Radio 0 Settings Register Bus": Queue<T1>, "Rx NI-USRP session": niUSRP, "Tx NI-USRP session": niUSRP, "FPGA Interface": any, "RIO Interface Number": u32, "EEPROM Header": T2, "Device Data Header": T3, "EEPROM Characterization Header": T4, "Characterization Data": T6[], "Characterization Data Valid?": bool, "Radio 1 Settings Register Bus": Queue<T1>, "Radio Settings Bus Semaphore": i32, "FPGA Current Version": u32, "FPGA Oldest Compatible Version": u32, "Fixed Logic Current Version": u32, "Fixed Logic Oldest Compatible Version": u32, "FPGA Radio Settings Bus Current Version": u32, "FPGA Radio Settings Bus Oldest Compatible Version": u32}
  T8 = cluster{"gain/level": f64, "sample rate [S/s]": f64, "frequency [Hz]": f64, "LO frequency [Hz]": f64, "active antenna": string}
diagram:
  w1 = T8 {"gain/level"=0, "sample rate [S/s]"=10000000, "frequency [Hz]"=2450000000, "LO frequency [Hz]"=-1, "active antenna"="RX1"}
  Property Node(instance in=w1, "gain/level"=$"level [dBm]", "sample rate [S/s]"=$"sample rate [S/s]", "frequency [Hz]"=$"frequency [Hz]", "LO frequency [Hz]"=$"LO frequency [Hz]", "active antenna"=$"Active Antenna") -> (instance out=w2)
  call "Configure Signal (Common).gvi"(niUsrpRio Session=$"niUsrpRio Session", signal parameters=w2, Configure Signal Mode="Level", error in=$"error in", scope=$scope, Correct Impairments?=$"Correct Impairments?") -> (niUsrpRio Session (out)=w3, coerced signal parameters=w4, error out=w5)
  $"niUsrpRio Session (out)" <- w3
  Property Node(instance in=w4) -> ("gain/level"=w6, "sample rate [S/s]"=w7, "frequency [Hz]"=w8, "LO frequency [Hz]"=w9)
  Divide(x=w6, y=10) -> w10
  Power Of X(x=10, y=w10) -> w11
  Divide(x=w11, y=10) -> w12
  Square Root(x=w12) -> w13
  Multiply(w13, 2) -> w14
  $"coerced vertical range [Vpp]" <- w14
  $"coerced level [dBm]" <- w6
  $"coerced sample rate [S/s]" <- w7
  $"coerced frequency [Hz]" <- w8
  $"coerced LO frequency [Hz]" <- w9
  $"error out" <- w5
