vi "Configure Start Trigger.gvi"   [LabVIEW NXG]
inputs:
  "start trigger": T8 = "Software"
  "niUsrpRio Session": T7 = {"EEPROM Header"={"Number of Reserved Bytes"=9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}, "Device Data Header"={"Number of Reserved Bytes"=27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}, "EEPROM Characterization Header"={"Number of Reserved Bytes"=28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}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}
  "error in": error
  "scope": string = "rx"
outputs:
  "niUsrpRio Session (out)": T7
  "error out": error
panel controls:
  "ConstantData2": any
types:
  T1 = cluster{"fpga ref": any, "bus instance": u32, "instruction FIFO depth": u32, "executing on FPGA target": bool, "show error call chain": bool}
  T2 = cluster{"Checksum": u32, "Product Code": u16, "Hardware Current Version": u16, "Hardware Oldest Compatible Version": u16, "EEPROM Map Current Version": u16, "EEPROM Map Oldest Compatible Version": u16, "User Password": string, "Pointer to Factory Header": u32, "Pointer to User Header": u32, "Recommended Interval": u16, "Number of Reserved Bytes": i32, "Number of Daughterboards": u8, "Daughterboard IDs": u16[], "Daughterboard Serial Numbers": string[]}
  T3 = cluster{"Checksum": u32, "Number of Channels": u8, "Number of Gain Settings": u16[], "Pointer to Characterization Data": u32[], "Number of Reserved Bytes": i32, "Number of Frequencies": u16[]}
  T4 = cluster{"Checksum": u32, "Date": timestamp, "Temperature": f32, "Misc. Info": string, "Pointer to Device Data Header": u32, "Number of Reserved Bytes": i32}
  T5 = cluster{"Gain Imbalance [linear]": f64, "Phase Imbalance [radians]": f64, "Offset": c128}
  T6 = cluster{"Gains[dB]": f64[], "Frequencies [Hz]": f64[], "IQ Imbalance Table": T5[], "Measured Gains[dB]": f64[][]}
  T7 = cluster{"Global Settings Register Bus": Queue<T1>, "Radio 0 Settings Register Bus": Queue<T1>, "Rx NI-USRP session": niUSRP, "Tx NI-USRP session": niUSRP, "FPGA Interface": any, "RIO Interface Number": u32, "EEPROM Header": T2, "Device Data Header": T3, "EEPROM Characterization Header": T4, "Characterization Data": T6[], "Characterization Data Valid?": bool, "Radio 1 Settings Register Bus": Queue<T1>, "Radio Settings Bus Semaphore": i32, "FPGA Current Version": u32, "FPGA Oldest Compatible Version": u32, "Fixed Logic Current Version": u32, "Fixed Logic Oldest Compatible Version": u32, "FPGA Radio Settings Bus Current Version": u32, "FPGA Radio Settings Bus Oldest Compatible Version": u32}
  T8 = enum{"Software", "Digital Edge", "Rx Start Trigger", "Tx Start Trigger", "Immediate"}
diagram:
  call "niUsrpRio Config v1 Host.lvlib__Parse Scope.gvi"(niUsrpRio Session=$"niUsrpRio Session", Error In=$"error in", scope=$scope) -> (niUsrpRio Session (out)=w1, Device Subfunction=w2, Error Out=w3)
  $"niUsrpRio Session (out)" <- w1
  Property Node(instance in=w1) -> ("FPGA Interface"=w4)
  Dynamic Fpga Interface Cast(FPGA VI Reference In=w4, Type=$ConstantData2) -> (FPGA VI Reference Out=w5)
  case (w2) {
    frame "rx", Default {
      Property Node(instance in=w5, error in=w3, "rx.trigger select"=$"start trigger") -> (error out=w6)
      Is Equal(x=$"start trigger", y="Rx Start Trigger") -> w7
      w9 = "-1: The Rx Start Trigger cannot be used for the Rx Start Trigger.  Select a different trigger for the Rx Start Trigger."
      call "Error Cluster From Error Code.gvi"(error code (0)=-1, error message ("")=w9, show call chain? (False)=TRUE, is warning? (False)=FALSE) -> (Error Out=w8)
    }
    frame "tx" {
      Property Node(instance in=w5, error in=w3, "tx.trigger select"=$"start trigger") -> (error out=w6)
      Is Equal(x=$"start trigger", y="Tx Start Trigger") -> w7
      w10 = "-1: The Tx Start Trigger cannot be used for the Tx Start Trigger.  Select a different trigger for the Tx Start Trigger."
      call "Error Cluster From Error Code.gvi"(error code (0)=-1, error message ("")=w10, show call chain? (False)=TRUE, is warning? (False)=FALSE) -> (Error Out=w8)
    }
  }
  call "Error Cluster From Error Code.gvi"(error code (0)=0, error message ("")="0: No Error", show call chain? (False)=TRUE, is warning? (False)=FALSE) -> (Error Out=w11)
  Select(s=w7, t=w8, f=w11) -> w12
  Merge Errors(w6, w12) -> (error out=w13)
  $"error out" <- w13
