vi "Configure Stream.gvi"   [LabVIEW NXG]
inputs:
  "niUsrpRio Session": T7 = {"EEPROM Header"={"Number of Reserved Bytes"=9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}, "Device Data Header"={"Number of Reserved Bytes"=27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}, "EEPROM Characterization Header"={"Number of Reserved Bytes"=28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}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}
  "host FIFO depth": u32 = 1000000
  "number of samples is finite": bool
  "number of samples": u32 = 8192
  "error in": error
  "scope": string = "rx"
outputs:
  "niUsrpRio Session (out)": T7
  "error out": error
panel controls:
  "ConstantData4": any
types:
  T1 = cluster{"fpga ref": any, "bus instance": u32, "instruction FIFO depth": u32, "executing on FPGA target": bool, "show error call chain": bool}
  T2 = cluster{"Checksum": u32, "Product Code": u16, "Hardware Current Version": u16, "Hardware Oldest Compatible Version": u16, "EEPROM Map Current Version": u16, "EEPROM Map Oldest Compatible Version": u16, "User Password": string, "Pointer to Factory Header": u32, "Pointer to User Header": u32, "Recommended Interval": u16, "Number of Reserved Bytes": i32, "Number of Daughterboards": u8, "Daughterboard IDs": u16[], "Daughterboard Serial Numbers": string[]}
  T3 = cluster{"Checksum": u32, "Number of Channels": u8, "Number of Gain Settings": u16[], "Pointer to Characterization Data": u32[], "Number of Reserved Bytes": i32, "Number of Frequencies": u16[]}
  T4 = cluster{"Checksum": u32, "Date": timestamp, "Temperature": f32, "Misc. Info": string, "Pointer to Device Data Header": u32, "Number of Reserved Bytes": i32}
  T5 = cluster{"Gain Imbalance [linear]": f64, "Phase Imbalance [radians]": f64, "Offset": c128}
  T6 = cluster{"Gains[dB]": f64[], "Frequencies [Hz]": f64[], "IQ Imbalance Table": T5[], "Measured Gains[dB]": f64[][]}
  T7 = cluster{"Global Settings Register Bus": Queue<T1>, "Radio 0 Settings Register Bus": Queue<T1>, "Rx NI-USRP session": niUSRP, "Tx NI-USRP session": niUSRP, "FPGA Interface": any, "RIO Interface Number": u32, "EEPROM Header": T2, "Device Data Header": T3, "EEPROM Characterization Header": T4, "Characterization Data": T6[], "Characterization Data Valid?": bool, "Radio 1 Settings Register Bus": Queue<T1>, "Radio Settings Bus Semaphore": i32, "FPGA Current Version": u32, "FPGA Oldest Compatible Version": u32, "Fixed Logic Current Version": u32, "Fixed Logic Oldest Compatible Version": u32, "FPGA Radio Settings Bus Current Version": u32, "FPGA Radio Settings Bus Oldest Compatible Version": u32}
diagram:
  call "niUsrpRio Config v1 Host.lvlib__Parse Scope.gvi"(niUsrpRio Session=$"niUsrpRio Session", Error In=$"error in", scope=$scope) -> (niUsrpRio Session (out)=w1, Device Subfunction=w2, Device Subfunction Channel=w3, Error Out=w4)
  $"niUsrpRio Session (out)" <- w1
  Select(s=$"number of samples is finite", t=$"number of samples", f=0) -> w5
  Multiply($"number of samples", 8) -> w6
  Max And Min(x=w6, y=$"host FIFO depth") -> (max(x,y)=w7: u32)
  Property Node(instance in=w1) -> ("FPGA Interface"=w8)
  Dynamic Fpga Interface Cast(FPGA VI Reference In=w8, Type=$ConstantData4) -> (FPGA VI Reference Out=w9)
  case (w2) {
    frame "tx" {
      Property Node(instance in=w9, error in=w4, "tx.samples to generate"=w5) -> (instance out=w12, error out=w13)
      case (w3) {
        frame "0", Default {
          Host Fifo Configure Node[FifoName="Tx Stream 0"](Depth=w7, Error In=w13, FPGA VI Reference In=w12) -> (Actual Depth=w11, Error Out=w14, FPGA VI Reference Out=w15)
          Host Fifo Stop Node[FifoName="Tx Stream 0"](Error In=w14, FPGA VI Reference In=w15) -> (Error Out=w16, FPGA VI Reference Out=w17)
          Host Fifo Start Node[FifoName="Tx Stream 0"](Error In=w16, FPGA VI Reference In=w17) -> (Error Out=w10)
        }
        frame "1" {
          Host Fifo Configure Node[FifoName="Tx Stream 1"](Depth=w7, Error In=w13, FPGA VI Reference In=w12) -> (Actual Depth=w11, Error Out=w18, FPGA VI Reference Out=w19)
          Host Fifo Stop Node[FifoName="Tx Stream 1"](Error In=w18, FPGA VI Reference In=w19) -> (Error Out=w20, FPGA VI Reference Out=w21)
          Host Fifo Start Node[FifoName="Tx Stream 1"](Error In=w20, FPGA VI Reference In=w21) -> (Error Out=w10)
        }
      }
    }
    frame "rx", Default {
      Property Node(instance in=w9, error in=w4, "rx.samples to acquire"=w5) -> (instance out=w22, error out=w23)
      case (w3) {
        frame "0", Default {
          Host Fifo Start Node[FifoName="Rx Stream 0"](Error In=w23, FPGA VI Reference In=w22) -> (Error Out=w24, FPGA VI Reference Out=w25)
          Host Fifo Stop Node[FifoName="Rx Stream 0"](Error In=w24, FPGA VI Reference In=w25) -> (Error Out=w26, FPGA VI Reference Out=w27)
          Host Fifo Configure Node[FifoName="Rx Stream 0"](Depth=w7, Error In=w26, FPGA VI Reference In=w27) -> (Actual Depth=w11, Error Out=w28, FPGA VI Reference Out=w29)
          Host Fifo Start Node[FifoName="Rx Stream 0"](Error In=w28, FPGA VI Reference In=w29) -> (Error Out=w10)
        }
        frame "1" {
          Host Fifo Start Node[FifoName="Rx Stream 1"](Error In=w23, FPGA VI Reference In=w22) -> (Error Out=w30, FPGA VI Reference Out=w31)
          Host Fifo Stop Node[FifoName="Rx Stream 1"](Error In=w30, FPGA VI Reference In=w31) -> (Error Out=w32, FPGA VI Reference Out=w33)
          Host Fifo Configure Node[FifoName="Rx Stream 1"](Depth=w7, Error In=w32, FPGA VI Reference In=w33) -> (Actual Depth=w11, Error Out=w34, FPGA VI Reference Out=w35)
          Host Fifo Start Node[FifoName="Rx Stream 1"](Error In=w34, FPGA VI Reference In=w35) -> (Error Out=w10)
        }
      }
    }
  }
  Is Greater Or Equal(x=w11, y=w7) -> w36
  call "Error Cluster From Error Code.gvi"(error code (0)=0, error message ("")="0: No Error", show call chain? (False)=TRUE, is warning? (False)=FALSE) -> (error out=w37)
  w38 = """-1: Unable to allocate enough memory for the host FIFO.

Requested FIFO size to allocate: %d samples
Actual FIFO size allocated: %d samples

Retry with a smaller number of samples to acquire/generate or provide a value for the host FIFO depth input. Note that host FIFO size must be greater-than-or-equal to the number of samples to acquire/generate."""
  Format Into String(formatString=w38, w7, w11) -> w39
  call "Error Cluster From Error Code.gvi"(error code (0)=-1, error message ("")=w39, show call chain? (False)=TRUE, is warning? (False)=FALSE) -> (error out=w40)
  Select(s=w36, t=w37, f=w40) -> w41
  Merge Errors(w10, w41) -> (error out=w42)
  $"error out" <- w42
