vi "Construct Channels.gvi"   [LabVIEW NXG]
inputs:
  "enabled channels": bool[]
  "antennas": string[]
  "frequencies": f64[]
  "lo frequencies": f64[]
  "levels": f64[]
  "scope": string
outputs:
  "channels": string[]
  "channel configurations": T1[]
types:
  T1 = cluster{"antenna": string, "frequency": f64, "lo frequency": f64, "level": f64}
diagram:
  s1 = string[] []  # shift register
  s2 = T1[] []  # shift register
  for (iteration -> i1) {
    w1 = each element of $"enabled channels"
    w2 = each element of $antennas
    w3 = each element of $frequencies
    w4 = each element of $"lo frequencies"
    w5 = each element of $levels
    call "Space Constant.gvi"() -> (String=w6)
    Number To Decimal String(number=i1) -> (decimal integer string=w7)
    Concatenate Strings($scope, "/RF", w6, w7) -> w8
    # Create name and configuration for each channel
    case (w1) {
      frame False, Default {
        w9 = s1
      }
      frame True {
        Build Array[ConcatenateInputs=True](s1, w8) -> w9
      }
    }
    w10 = T1 {"antenna"="RX1", "frequency"=2000000000, "lo frequency"=-1, "level"=0}
    Property Node(instance in=w10, "antenna"=w2, "frequency"=w3, "lo frequency"=w4, "level"=w5) -> (instance out=w11)
    case (w1) {
      frame False, Default {
        w12 = s2
      }
      frame True {
        Build Array[ConcatenateInputs=True](s2, w11) -> w12
      }
    }
    next s1 = w9
    next s2 = w12
  }
  $channels <- s1
  $"channel configurations" <- s2
