vi "Fetch Rx Data (U32).gvi"   [LabVIEW NXG]
inputs:
  "niUsrpRio Session": T7 = {"EEPROM Header"={"Number of Reserved Bytes"=9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}, "Device Data Header"={"Number of Reserved Bytes"=27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}, "EEPROM Characterization Header"={"Number of Reserved Bytes"=28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}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}
  "number of samples": u32 = 8192
  "timeout": f64 = 10
  "error in": error
  "scope": string
  "vertical range [Vpp]": f64 = 2
  "leading samples to trim": u32
outputs:
  "niUsrpRio Session (out)": T7
  "waveform data": u32[]
  "error out": error
  "scaling (V/code)": f64
panel controls:
  "ConstantData3": any
types:
  T1 = cluster{"fpga ref": any, "bus instance": u32, "instruction FIFO depth": u32, "executing on FPGA target": bool, "show error call chain": bool}
  T2 = cluster{"Checksum": u32, "Product Code": u16, "Hardware Current Version": u16, "Hardware Oldest Compatible Version": u16, "EEPROM Map Current Version": u16, "EEPROM Map Oldest Compatible Version": u16, "User Password": string, "Pointer to Factory Header": u32, "Pointer to User Header": u32, "Recommended Interval": u16, "Number of Reserved Bytes": i32, "Number of Daughterboards": u8, "Daughterboard IDs": u16[], "Daughterboard Serial Numbers": string[]}
  T3 = cluster{"Checksum": u32, "Number of Channels": u8, "Number of Gain Settings": u16[], "Pointer to Characterization Data": u32[], "Number of Reserved Bytes": i32, "Number of Frequencies": u16[]}
  T4 = cluster{"Checksum": u32, "Date": timestamp, "Temperature": f32, "Misc. Info": string, "Pointer to Device Data Header": u32, "Number of Reserved Bytes": i32}
  T5 = cluster{"Gain Imbalance [linear]": f64, "Phase Imbalance [radians]": f64, "Offset": c128}
  T6 = cluster{"Gains[dB]": f64[], "Frequencies [Hz]": f64[], "IQ Imbalance Table": T5[], "Measured Gains[dB]": f64[][]}
  T7 = cluster{"Global Settings Register Bus": Queue<T1>, "Radio 0 Settings Register Bus": Queue<T1>, "Rx NI-USRP session": niUSRP, "Tx NI-USRP session": niUSRP, "FPGA Interface": any, "RIO Interface Number": u32, "EEPROM Header": T2, "Device Data Header": T3, "EEPROM Characterization Header": T4, "Characterization Data": T6[], "Characterization Data Valid?": bool, "Radio 1 Settings Register Bus": Queue<T1>, "Radio Settings Bus Semaphore": i32, "FPGA Current Version": u32, "FPGA Oldest Compatible Version": u32, "Fixed Logic Current Version": u32, "Fixed Logic Oldest Compatible Version": u32, "FPGA Radio Settings Bus Current Version": u32, "FPGA Radio Settings Bus Oldest Compatible Version": u32}
diagram:
  call "niUsrpRio Config v1 Host.lvlib__Parse Scope.gvi"(niUsrpRio Session=$"niUsrpRio Session", Error In=$"error in", scope=$scope) -> (niUsrpRio Session (out)=w1, Device Subfunction Channel=w2, Error Out=w3)
  $"niUsrpRio Session (out)" <- w1
  Multiply($timeout, 1000) -> w4
  Property Node(instance in=w1) -> ("FPGA Interface"=w5)
  Dynamic Fpga Interface Cast(FPGA VI Reference In=w5, Type=$ConstantData3) -> (FPGA VI Reference Out=w6)
  case (w2) {
    frame "0", Default {
      Host Fifo Read Node[FifoName="Rx Stream 0"](Error In=w3, FPGA VI Reference In=w6, Number of Elements=$"number of samples", Timeout (ms)=w4) -> (Data=w9, Error Out=w7, FPGA VI Reference Out=w8)
    }
    frame "1" {
      Host Fifo Read Node[FifoName="Rx Stream 1"](Error In=w3, FPGA VI Reference In=w6, Number of Elements=$"number of samples", Timeout (ms)=w4) -> (Data=w9, Error Out=w7, FPGA VI Reference Out=w8)
    }
  }
  Array Size(array=w9) -> (size(s)=w10)
  Is Less(x=w10, y=$"number of samples") -> w11
  case (w11) {
    frame False, Default {
      w12 = w7
      w13 = w9
    }
    frame True {
      call "Error Cluster From Error Code.gvi"(error code (0)=-1, error message ("")="Timeout waiting\nfor samples.", show call chain? (False)=TRUE) -> (error out=w14)
      Merge Errors(w7, w14) -> (error out=w12)
      w13 = w9
    }
  }
  Split 1D Array(array=w13, index=$"leading samples to trim") -> (second subarray=w15)
  $"waveform data" <- w15
  $"error out" <- w12
  Scale By Power Of 2(n=16, x=1) -> w16
  Divide(x=$"vertical range [Vpp]", y=w16) -> w17
  $"scaling (V/code)" <- w17
