vi "Generate Waveform (Multi-Array).gvi"   [LabVIEW NXG]
inputs:
  "number of samples": u32 = 300000
  "sample rate": f64 = 10000000
  "tone frequency": f64 = 130000
  "amplitude": f64 = 1
outputs:
  "I": i16[]
  "Q": i16[]
  "Waveform": waveform<f64>[]
  "error out": error
diagram:
  Property Node(instance in=cluster{"Fs": f64, "#s": f64} {"Fs"=1000, "#s"=1000}, "Fs"=$"sample rate", "#s"=$"number of samples") -> (instance out=w1)
  # Generates two sinewaves with with 90 degree phase difference and convert to IQ signals.
  # This code should be modified for your application.
  call "Sine Waveform.gvi"(frequency=$"tone frequency", amplitude=$amplitude, phase=90, sampling info=w1) -> (signal out=w2, Error Out=w3)
  call "Sine Waveform.gvi"(frequency=$"tone frequency", amplitude=$amplitude, sampling info=w1) -> (signal out=w4, Error Out=w5)
  Build Array(w2, w4) -> w6
  $Waveform <- w6
  Property Node(instance in=w2) -> ("Y"=w7)
  Multiply(w7, 32767) -> w8
  To Word Integer(number=w8) -> w9
  $I <- w9
  Property Node(instance in=w4) -> ("Y"=w10)
  Multiply(w10, 32767) -> w11
  To Word Integer(number=w11) -> w12
  $Q <- w12
  Merge Errors(w3, w5) -> (error out=w13)
  $"error out" <- w13
