vi "Initiate Stream.gvi"   [LabVIEW NXG]
inputs:
  "niUsrpRio Session": T7 = {"EEPROM Header"={"Number of Reserved Bytes"=9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}, "Device Data Header"={"Number of Reserved Bytes"=27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}, "EEPROM Characterization Header"={"Number of Reserved Bytes"=28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}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}
  "error in": error
  "scope": string = "rx"
outputs:
  "niUsrpRio Session (out)": T7
  "error out": error
panel controls:
  "ConstantData2": any
types:
  T1 = cluster{"fpga ref": any, "bus instance": u32, "instruction FIFO depth": u32, "executing on FPGA target": bool, "show error call chain": bool}
  T2 = cluster{"Checksum": u32, "Product Code": u16, "Hardware Current Version": u16, "Hardware Oldest Compatible Version": u16, "EEPROM Map Current Version": u16, "EEPROM Map Oldest Compatible Version": u16, "User Password": string, "Pointer to Factory Header": u32, "Pointer to User Header": u32, "Recommended Interval": u16, "Number of Reserved Bytes": i32, "Number of Daughterboards": u8, "Daughterboard IDs": u16[], "Daughterboard Serial Numbers": string[]}
  T3 = cluster{"Checksum": u32, "Number of Channels": u8, "Number of Gain Settings": u16[], "Pointer to Characterization Data": u32[], "Number of Reserved Bytes": i32, "Number of Frequencies": u16[]}
  T4 = cluster{"Checksum": u32, "Date": timestamp, "Temperature": f32, "Misc. Info": string, "Pointer to Device Data Header": u32, "Number of Reserved Bytes": i32}
  T5 = cluster{"Gain Imbalance [linear]": f64, "Phase Imbalance [radians]": f64, "Offset": c128}
  T6 = cluster{"Gains[dB]": f64[], "Frequencies [Hz]": f64[], "IQ Imbalance Table": T5[], "Measured Gains[dB]": f64[][]}
  T7 = cluster{"Global Settings Register Bus": Queue<T1>, "Radio 0 Settings Register Bus": Queue<T1>, "Rx NI-USRP session": niUSRP, "Tx NI-USRP session": niUSRP, "FPGA Interface": any, "RIO Interface Number": u32, "EEPROM Header": T2, "Device Data Header": T3, "EEPROM Characterization Header": T4, "Characterization Data": T6[], "Characterization Data Valid?": bool, "Radio 1 Settings Register Bus": Queue<T1>, "Radio Settings Bus Semaphore": i32, "FPGA Current Version": u32, "FPGA Oldest Compatible Version": u32, "Fixed Logic Current Version": u32, "Fixed Logic Oldest Compatible Version": u32, "FPGA Radio Settings Bus Current Version": u32, "FPGA Radio Settings Bus Oldest Compatible Version": u32}
diagram:
  call "niUsrpRio Config v1 Host.lvlib__Parse Scope.gvi"(niUsrpRio Session=$"niUsrpRio Session", Error In=$"error in", scope=$scope) -> (niUsrpRio Session (out)=w1, Device Subfunction=w2, Device Subfunction Channel=w3, Error Out=w4)
  $"niUsrpRio Session (out)" <- w1
  Property Node(instance in=w1) -> ("FPGA Interface"=w5)
  Dynamic Fpga Interface Cast(FPGA VI Reference In=w5, Type=$ConstantData2) -> (FPGA VI Reference Out=w6)
  case (w2) {
    frame "tx" {
      Property Node(instance in=w6, error in=w4, "tx.enable trigger"=FALSE) -> (instance out=w8, error out=w9)
      case (w3) {
        frame "0", Default {
          Property Node(instance in=w8, error in=w9, "tx 0.stream enabled"=FALSE) -> (instance out=w11, error out=w10)
        }
        frame "All" {
          Property Node(instance in=w8, error in=w9, "tx 0.stream enabled"=FALSE, "tx 1.stream enabled"=FALSE) -> (instance out=w11, error out=w10)
        }
        frame "1" {
          Property Node(instance in=w8, error in=w9, "tx 1.stream enabled"=FALSE) -> (instance out=w11, error out=w10)
        }
      }
      Property Node(instance in=w11, error in=w10, "tx.abort"=FALSE) -> (instance out=w12, error out=w13)
      Property Node(instance in=w12, error in=w13, "tx.reset"=FALSE, "tx.reset"=TRUE, "tx.reset"=FALSE) -> (instance out=w14, error out=w15)
      while (iteration -> i1) {
        Property Node(instance in=w14, error in=w15) -> (instance out=w16, error out=w17, "tx.dsp reset done"=w18)
        Is Equal To 0(x=i1) -> w19
        call "Elapsed Time.gvi"(Time Target (s)=1, Reset=w19) -> (Time has Elapsed=w20)
        Logical Or(w17, w18, w20) -> w21
        stop if w21
      }
      Property Node(instance in=w16, error in=w17) -> (instance out=w22, error out=w23, "tx.dsp reset done"=w24)
      call "Error Cluster From Error Code.gvi"(error code (0)=-1, error message ("")="-1: Tx DSP failed to reset within time limit.", show call chain? (False)=TRUE, is warning? (False)=FALSE) -> (error out=w25)
      call "Error Cluster From Error Code.gvi"(error code (0)=0, error message ("")="0: No Error", show call chain? (False)=TRUE, is warning? (False)=FALSE) -> (error out=w26)
      Select(s=w24, t=w26, f=w25) -> w27
      Merge Errors(w23, w27) -> (error out=w28)
      case (w3) {
        frame "0", Default {
          Property Node(instance in=w22, error in=w28, "tx 0.stream enabled"=TRUE) -> (instance out=w30, error out=w29)
        }
        frame "All" {
          Property Node(instance in=w22, error in=w28, "tx 0.stream enabled"=TRUE, "tx 1.stream enabled"=TRUE) -> (instance out=w30, error out=w29)
        }
        frame "1" {
          Property Node(instance in=w22, error in=w28, "tx 1.stream enabled"=TRUE) -> (instance out=w30, error out=w29)
        }
      }
      Property Node(instance in=w30, error in=w29, "tx.enable trigger"=TRUE) -> (error out=w7)
    }
    frame "rx", Default {
      Property Node(instance in=w6, error in=w4, "rx.enable trigger"=FALSE) -> (instance out=w31, error out=w32)
      case (w3) {
        frame "0", Default {
          Property Node(instance in=w31, error in=w32, "rx 0.stream enabled"=FALSE) -> (instance out=w33, error out=w34)
        }
        frame "All" {
          Property Node(instance in=w31, error in=w32, "rx 0.stream enabled"=FALSE, "rx 1.stream enabled"=FALSE) -> (instance out=w33, error out=w34)
        }
        frame "1" {
          Property Node(instance in=w31, error in=w32, "rx 1.stream enabled"=FALSE) -> (instance out=w33, error out=w34)
        }
      }
      Property Node(instance in=w33, error in=w34, "rx.abort"=FALSE) -> (instance out=w35, error out=w36)
      Property Node(instance in=w35, error in=w36, "rx.reset"=FALSE, "rx.reset"=TRUE, "rx.reset"=FALSE) -> (instance out=w37, error out=w38)
      while (iteration -> i2) {
        Property Node(instance in=w37, error in=w38) -> (instance out=w39, error out=w40, "rx.dsp reset done"=w41)
        Is Equal To 0(x=i2) -> w42
        call "Elapsed Time.gvi"(Time Target (s)=1, Reset=w42) -> (Time has Elapsed=w43)
        Logical Or(w40, w41, w43) -> w44
        stop if w44
      }
      Property Node(instance in=w39, error in=w40) -> (instance out=w45, error out=w46, "rx.dsp reset done"=w47)
      call "Error Cluster From Error Code.gvi"(error code (0)=-1, error message ("")="-1: Rx DSP failed to reset within time limit.", show call chain? (False)=TRUE, is warning? (False)=FALSE) -> (error out=w48)
      call "Error Cluster From Error Code.gvi"(error code (0)=0, error message ("")="0: No Error", show call chain? (False)=TRUE, is warning? (False)=FALSE) -> (error out=w49)
      Select(s=w47, t=w49, f=w48) -> w50
      Merge Errors(w46, w50) -> (error out=w51)
      case (w3) {
        frame "0", Default {
          Property Node(instance in=w45, error in=w51, "rx 0.stream enabled"=TRUE) -> (instance out=w52, error out=w53)
        }
        frame "All" {
          Property Node(instance in=w45, error in=w51, "rx 0.stream enabled"=TRUE, "rx 1.stream enabled"=TRUE) -> (instance out=w52, error out=w53)
        }
        frame "1" {
          Property Node(instance in=w45, error in=w51, "rx 1.stream enabled"=TRUE) -> (instance out=w52, error out=w53)
        }
      }
      Property Node(instance in=w52, error in=w53, "rx.enable trigger"=TRUE) -> (error out=w7)
    }
  }
  $"error out" <- w7
