vi "Multi Device Initiate.gvi"   [LabVIEW NXG]
inputs:
  "niUsrpRio Sessions": T7[], required
  "start trigger": T8 = "Software", required
  "error in": error
  "scope": string = "rx", required
outputs:
  "niUsrpRio Sessions (out)": T7[]
  "error out": error
types:
  T1 = cluster{"fpga ref": any, "bus instance": u32, "instruction FIFO depth": u32, "executing on FPGA target": bool, "show error call chain": bool}
  T2 = cluster{"Checksum": u32, "Product Code": u16, "Hardware Current Version": u16, "Hardware Oldest Compatible Version": u16, "EEPROM Map Current Version": u16, "EEPROM Map Oldest Compatible Version": u16, "User Password": string, "Pointer to Factory Header": u32, "Pointer to User Header": u32, "Recommended Interval": u16, "Number of Reserved Bytes": i32, "Number of Daughterboards": u8, "Daughterboard IDs": u16[], "Daughterboard Serial Numbers": string[]}
  T3 = cluster{"Checksum": u32, "Number of Channels": u8, "Number of Gain Settings": u16[], "Pointer to Characterization Data": u32[], "Number of Reserved Bytes": i32, "Number of Frequencies": u16[]}
  T4 = cluster{"Checksum": u32, "Date": timestamp, "Temperature": f32, "Misc. Info": string, "Pointer to Device Data Header": u32, "Number of Reserved Bytes": i32}
  T5 = cluster{"Gain Imbalance [linear]": f64, "Phase Imbalance [radians]": f64, "Offset": c128}
  T6 = cluster{"Gains[dB]": f64[], "Frequencies [Hz]": f64[], "IQ Imbalance Table": T5[], "Measured Gains[dB]": f64[][]}
  T7 = cluster{"Global Settings Register Bus": Queue<T1>, "Radio 0 Settings Register Bus": Queue<T1>, "Rx NI-USRP session": niUSRP, "Tx NI-USRP session": niUSRP, "FPGA Interface": any, "RIO Interface Number": u32, "EEPROM Header": T2, "Device Data Header": T3, "EEPROM Characterization Header": T4, "Characterization Data": T6[], "Characterization Data Valid?": bool, "Radio 1 Settings Register Bus": Queue<T1>, "Radio Settings Bus Semaphore": i32, "FPGA Current Version": u32, "FPGA Oldest Compatible Version": u32, "Fixed Logic Current Version": u32, "Fixed Logic Oldest Compatible Version": u32, "FPGA Radio Settings Bus Current Version": u32, "FPGA Radio Settings Bus Oldest Compatible Version": u32}
  T8 = enum{"Software", "Digital Edge", "Rx Start Trigger", "Tx Start Trigger", "Immediate"}
diagram:
  Reverse 1D Array(array=$"niUsrpRio Sessions") -> (reversed array=w1)
  s1 = $"error in"  # shift register
  for {
    w2 = each element of w1
    call "Initiate Stream.gvi"(niUsrpRio Session=w2, error in=s1, scope=$scope) -> (niUsrpRio Session (out)=w3, error out=w4)
    next s1 = w4
  }
  case ($"start trigger") {
    frame "Software" {
      call "Send Software Start Trigger.gvi"(niUsrpRio Session=w3, error in=s1, scope=$scope) -> (error out=w5)
    }
    frame Default {
      w5 = s1
    }
  }
  $"error out" <- w5
  $"niUsrpRio Sessions (out)" <- $"niUsrpRio Sessions"
