vi "mainFPGA_VI.gvi"   [LabVIEW NXG 4.0.0]
panel controls:
  "TX": i32
  "RX": i32
  "Register Bus & Required": i32
  "PHYparameters": T3 = {0, 0, 0, 0, "0x1FFFF", "0x1FFFF", 0, 0, 0, 0, 0, 0, "0x200000", "0x200000"}
  "reg.host read.go rcvd 0": bool
  "reg.notify host.go rcvd 0": bool
  "reg.reset 0": bool
  "RF 0/Rx/Enable": bool
  "RF 0/Tx/Enable": bool
  "RF 1/Rx/Enable": bool
  "RF 1/Tx/Enable": bool
  "PHYparameters_RX": T4 = {0, 0, 0, 0, "0x1FFFF", "0x1FFFF", 0, 0, 0, 0, 0, 0, "0x200000", "0x200000"}
  "TransmiteData": bool
  "RX_Data_With TX busy": bool
  "Write modulated data to memory": bool
  "KUL DiSIC Setting": T5
  "DiSIC data collector Setting": T6
  "Data Collector SR": UFXP(1.47) = 0.66
panel indicators:
  "reg.notify host.go 0": bool
  "reg.host read.data 0": cluster{"go": bool, "data": u32}
  "TX.PHYbusy": bool
types:
  T1 = cluster{"inline gain I": FXP(1.17), "inline gain Q": FXP(1.17), "cross gain I": FXP(1.17), "cross gain Q": FXP(1.17), "pre-gain offset I": FXP(1.17), "pre-gain offset Q": FXP(1.17), "post-gain offset I": FXP(1.17), "post-gain offset Q": FXP(1.17)}
  T2 = cluster{"gain I": FXP(3.21), "gain Q": FXP(3.21)}
  T3 = cluster{"delay": FXP(0.18), "input sample rate": UFXP(1.47), "frequency shift": FXP(0.48), "phase": FXP(0.21), "impairments": T1, "gain": T2}
  T4 = cluster{"delay": FXP(0.18), "output sample rate": UFXP(1.47), "frequency shift": FXP(0.48), "phase": FXP(0.21), "impairments": T1, "gain": T2}
  T5 = cluster{"Offset Q": i16, "Offset I": i16, "mu_in": FXP(0.28), "Update_Sample": u16, "Freez_coff": bool, "Update_coff": bool, " RST": bool}
  T6 = cluster{"Canceller on 120M?": bool, "x": u16, "Tx busy send Zero": bool}
  T7 = cluster{"I": FXP(1.17), "Q": FXP(1.17), "overflow": bool}
uses:
  FPGA-subVIs::USRP::Create Resources.gvi
  NI::SDR::RegisterBusV1FPGA::Process.gcdl
  FPGA-subVIs::USRP::Registers.gcdl
  NI::USRPRIO::ConfigV1FPGA::Process.gvi
  NI::SDR::DSPV1FPGA::I16 to IQ.gcdl
  NI::SDR::DSPV1FPGA::IQ Impairments - 1 spc.gcdl
  NI::SDR::DSPV1FPGA::Digital Gain - 1 spc.gcdl
  NI::SDR::DSPV1FPGA::Fractional Interpolator - 1 spc - 2x oc.gcdl
  NI::SDR::DSPV1FPGA::Frequency Shift - 1 spc.gcdl
  FPGA-subVIs::KUL_DiSIC::Collect Data For DiSIC.gcdl
  NI::SDR::DSPV1FPGA::Fractional Decimator - 1 spc - 2x oc.gcdl
  NI::SDR::DSPV1FPGA::IQ to I16.gcdl
  NI::SDR::BasicElementsV1FPGA::Detect Rising Edge.gcdl
  ::USRP::Interactive::FPGA-subVIs::KUL_DiSIC::KUL-DiSIC.eip
diagram:
  call "Create Resources.gvi"() -> (config.resources=w1, sync.resources=w2, time.resources=w3)
  clock-driven loop (clock = "40 MHz Onboard Clock") {
    Register Read(reference in="USRP Resources::USRP Resources.grsc::TX.PHYbusy") -> (data=w4)
    $"TX.PHYbusy" <- w4
    Io Write(data=$"RF 1/Rx/Enable", reference in="RF 1/Rx/Enable")
    Io Write(data=$"RF 0/Tx/Enable", reference in="RF 0/Tx/Enable")
    Io Write(data=$"RF 0/Rx/Enable", reference in="RF 0/Rx/Enable")
    Io Write(data=$"RF 1/Tx/Enable", reference in="RF 1/Tx/Enable")
    w5 = "NI::SDR::RegisterBusV1FPGA::niInstr Register Bus v0.grsc::reg.host instruction fifo 0"
    Feedback Node(input=w6) -> w7
    Feedback Node(input=w8) -> w9
    call "Process.gcdl"(reg.notify host.go rcvd=$"reg.notify host.go rcvd 0", reg.host read.go rcvd=$"reg.host read.go rcvd 0", read completion=w7, reg.reset=$"reg.reset 0", reg.host instruction fifo=w5, ready for output=w9) -> (reg.notify host.go=w10, reg.host read.data=w11, register instruction=w12)
    $"reg.notify host.go 0" <- w10
    $"reg.host read.data 0" <- w11
    Register Write(data=$TransmiteData, reference in="USRP Resources::USRP Resources.grsc::TransmiteData")
    call "Registers.gcdl"(register instruction=w12, config.resources=w1, sync.resources=w2, time.resources=w3) -> (ready for input=w8, read completion out=w6)
    stop if FALSE
  }
  call "Process.gvi"(resources=w1)
  clock-driven loop (clock = "Data Clock") forever {
    Property Node(instance in=$PHYparameters_RX) -> ("impairments"=w13, "frequency shift"=w14, "phase"=w15, "output sample rate"=w16, "delay"=w17)
    Io Read(reference in="RF 1/Rx/I") -> (data=w18)
    Io Read(reference in="RF 1/Rx/Q") -> (data=w19)
    call "I16 to IQ.gcdl"(I=w18, Q=w19) -> (IQ data=w20)
    call "IQ Impairments - 1 spc.gcdl"(data in=w20, impairments=w13, input valid=TRUE) -> (data out=w21, output valid=w22)
    Property Node(instance in=$PHYparameters) -> ("gain"=w23, "input sample rate"=w24, "delay"=w25, "frequency shift"=w26, "phase"=w27, "impairments"=w28)
    Register Read(reference in="USRP Resources::USRP Resources.grsc::TransmiteData") -> (data=w29)
    Not(x=$"Write modulated data to memory") -> w30
    Feedback Node(input=w31) -> w32
    Logical And(w30, w29, w32) -> w33
    w34 = "USRP Resources::USRP Resources.grsc::Modulated Data Internal FIFO"
    FIFO Read(Control Protocol Input=w33, reference in=w34) -> (Control Protocol Output=w35, data=w36)
    Split Number(x=w36) -> (high(x)=w37, low(x)=w38)
    To Signed 16 Bit Integer(number=w37) -> w39
    To Signed 16 Bit Integer(number=w38) -> w40
    call "I16 to IQ.gcdl"(I=w39, Q=w40) -> (IQ data=w41)
    Feedback Node(input=w42) -> w43
    call "Digital Gain - 1 spc.gcdl"(data in=w41, gain=w23, input valid=w35, ready for output (T)=w43) -> (data out=w44, output valid=w45, ready for input=w31)
    call "Fractional Interpolator - 1 spc - 2x oc.gcdl"(data in=w44, input sample rate=w24, delay=w25, input valid=w45, clock x 2="Data Clock x2") -> (data out=w46, output valid=w47, ready for input=w48)
    Feedback Node(input=w49) -> w50
    call "Frequency Shift - 1 spc.gcdl"(data in=w46, frequency shift=w26, phase=w27, input valid=w47, ready for output (T)=w50) -> (data out=w51, output valid=w52, ready for input=w53)
    call "Collect Data For DiSIC.gcdl"(Data From Tx=w51, Data Valid From Tx=w52, Data In From Rx=w21, Data Valid In From Rx=w22, DiSIC data collector Setting=$"DiSIC data collector Setting", Data Collector SR=$"Data Collector SR") -> (Tx busy=w54, Data Out To Rx=w55, Data Vali Out to Rx=w56)
    call "Frequency Shift - 1 spc.gcdl"(data in=w55, frequency shift=w14, phase=w15, input valid=w56) -> (data out=w57, output valid=w58)
    call "Fractional Decimator - 1 spc - 2x oc.gcdl"(data in=w57, output sample rate=w16, delay=w17, input valid=w58, clock x 2="Data Clock x2") -> (data out=w59, output valid=w60)
    call "IQ to I16.gcdl"(IQ data=w59) -> (I=w61, Q=w62)
    To Fixed Point(number=w62) -> w63
    High Throughput Multiply[PipeliningStages=1, WithFourWireMode=True](input valid=w60, x=w63, y=w63) -> (x*y=w64: UFXP(31.0) Saturate:ConvergentRounding, output valid=w65)
    To Fixed Point(number=w61) -> w66
    High Throughput Multiply[PipeliningStages=1, WithFourWireMode=True](input valid=w60, x=w66, y=w66) -> w67: UFXP(31.0) Saturate:ConvergentRounding
    Add(w67, w64) -> w68
    High Throughput Square Root(input valid=w65, x=w68) -> (sqrt(x)=w69: UFXP(16.16), output valid=w70)
    FIFO Write(Control Protocol Input=w70, data=w69, reference in="USRP Resources::USRP Resources.grsc::SamplesForKP")
    FIFO Write(Control Protocol Input=w70, data=w69, reference in="USRP Resources::USRP Resources.grsc::SamplesForCCA")
    Join Numbers(high(x)=w61, low(x)=w62) -> w71
    call "IQ Impairments - 1 spc.gcdl"(data in=w51, impairments=w28, input valid=w52) -> (data out=w72, output valid=w73, ready for input=w49)
    Select(s=$"RX_Data_With TX busy", t=w73, f=TRUE) -> w74
    Logical And(w60, w74) -> w75
    # RX data to Host
    FIFO Write(Control Protocol Input=w75, data=w71, reference in="USRP Resources::USRP Resources.grsc::RX_data")
    FIFO Write(Control Protocol Input=w60, data=w71, reference in="USRP Resources::USRP Resources.grsc::RX.data")
    Register Write(data=w54, reference in="USRP Resources::USRP Resources.grsc::Tx.Busy.forRadar")
    call "Detect Rising Edge.gcdl"(signal=$"Write modulated data to memory") -> (edge detected=w76)
    w77 = "USRP Resources::USRP Resources.grsc::Modulated data from host"
    FIFO Read(Control Protocol Input=TRUE, reference in=w77) -> (Control Protocol Output=w78, data=w79)
    Feedback Node(input=w36) -> w80
    Select(s=$"Write modulated data to memory", t=w79, f=w80) -> w81
    Feedback Node(input=w35) -> w82
    Select(s=$"Write modulated data to memory", t=w78, f=w82) -> w83
    w84 = "USRP Resources::USRP Resources.grsc::Modulated Data Internal FIFO"
    FIFO Write(Control Protocol Input=w83, data=w81, reference in=w84) -> (reference out=w85)
    FIFO Clear(reference in=w85, start=w76)
    case (w73) {
      frame False, Default {
        w86 = T7 {all zero or empty}
      }
      frame True {
        w86 = w72
      }
    }
    call "IQ to I16.gcdl"(IQ data=w86) -> (I=w87, Q=w88)
    Io Write(data=w87, reference in="RF 0/Tx/I")
    Io Write(data=w88, reference in="RF 0/Tx/Q")
    Logical And(w53, w48) -> w42
    Register Write(data=w73, reference in="USRP Resources::USRP Resources.grsc::TX.TXbusy")
  }
  clock-driven loop (clock = "USRP Resources::USRP Resources.grsc::100.1M") forever {
    FIFO Read(Control Protocol Input=TRUE, reference in="USRP Resources::USRP Resources.grsc::DX_FIFO") -> (Control Protocol Output=w89, data=w90)
    # w91: Rx
    # w92: Tx
    Split Number(x=w90) -> (high(x)=w91, low(x)=w92)
    Property Node(instance in=$"KUL DiSIC Setting") -> ("Offset Q"=w93, "Offset I"=w94, " RST"=w95, "mu_in"=w96, "Update_Sample"=w97, "Update_coff"=w98, "Freez_coff"=w99)
    Split Number(x=w91) -> (high(x)=w100, low(x)=w101)
    To Signed 16 Bit Integer(number=w100) -> w102
    Subtract(x=w102, y=w93) -> w103
    To Signed 16 Bit Integer(number=w101) -> w104
    Subtract(x=w104, y=w94) -> w105
    Join Numbers(high(x)=w103, low(x)=w105) -> w106
    Join Numbers(high(x)=w106, low(x)=w92) -> w107
    FIFO Write(Control Protocol Input=w89, data=w107, reference in="USRP Resources::USRP Resources.grsc::dx to host")
    Split Number(x=w92) -> (high(x)=w108, low(x)=w109)
    To Signed 16 Bit Integer(number=w108) -> w110
    To Signed 16 Bit Integer(number=w109) -> w111
    Not(x=w99) -> w112
    Register Read(reference in="USRP Resources::USRP Resources.grsc::Tx.Busy.forRadar") -> (data=w113)
    Logical Or(w98, w113) -> w114
    Logical And(w114, w112) -> w115
    Discrete Delay(D=w105, enable=w89, index=6) -> (Q=w116)
    Discrete Delay(D=w103, enable=w89, index=6) -> (Q=w117)
    Reinterpret Number[RestrictToSameWordLength=True](data in=w96, type=FXP(28.0) 0) -> (data out=w118)
    call "KUL-DiSIC.eip"(Valid_In=w89, RST=w95, Ref_I=w111, Ref_Q=w110, Rec_I=w116, Rec_Q=w117, mu_in=w118, Update_coff=w115, Update_Sample=w97) -> (Valid_Out=w119: bool, E_I=w120: i16, E_Q=w121: i16)
    Join Numbers(high(x)=w121, low(x)=w120) -> w122
    Join Numbers(high(x)=w122, low(x)=w92) -> w123
    FIFO Write(Control Protocol Input=w119, data=w123, reference in="USRP Resources::USRP Resources.grsc::E_FIFO")
  }
