vi "InitUSRP.gvi"   [LabVIEW NXG 4.0.0]
inputs:
  "General Setting": T1 = {"Firmware, Tx MAC"=path "C:\\Users\\shassani\\Desktop\\MY_IBFD\\Microblaze\\Workspace\\mbCSMA\\Debug\\mbCSMA.bin", "Firmware, Duplexer"=path "C:\\Users\\shassani\\Desktop\\MY_IBFD\\Microblaze\\Workspace\\mbImecDuplexer\\Debug\\mbImecDuplexer.bin", "TX Sample Rate"=16000000, "TX Antenna"="TX/RX", "RX Antenna"="RX2", "Frequency Shift"=-10000000, "Frequency (Hz)"=1750000000, "RX Scope"="rx/RF 1", "TX Scope"="tx/RF 0", "Reference Frequency Source"="Internal", "RX Sample Rate"=16000000}
  "PHY Source": u8
  "TX Gain": f64 = 10
  "RX Gain": f64
  "RIO Add": string
outputs:
  "Session": "niUsrpRio Session.gtype"
  "FPGA Reference_out": "FPGA Reference.gtype"
  "Calibration Factor": f64
  "Error": error
panel controls:
  "FPGA Reference": "FPGA Reference.gtype"
types:
  "Register Bus Session.gtype" = Queue<"Session Data.gtype">
  "Semaphore.gtype" = i32
  "DB Queue Reference.gtype" = Queue<"Daughterboard Data.gtype">
  "EEPROM Header.gtype" = cluster{"Checksum": u32, "Product Code": u16, "Hardware Current Version": u16, "Hardware Oldest Compatible Version": u16, "EEPROM Map Current Version": u16, "EEPROM Map Oldest Compatible Version": u16, "User Password": string, "Pointer to Factory Header": u32, "Pointer to User Header": u32, "Recommended Interval": u16, "Number of Reserved Bytes": i32, "Number of Daughterboards": u8, "Daughterboard IDs": u16[], "Daughterboard Serial Numbers": string[]}
  "EEPROM Device Data Header.gtype" = cluster{"Checksum": u32, "Number of Channels": u8, "Number of Gain Settings": u16[], "Pointer to Characterization Data": u32[], "Number of Reserved Bytes": i32, "Number of Frequencies": u16[]}
  "EEPROM Characterization Header.gtype" = cluster{"Checksum": u32, "Date": timestamp, "Temperature": f32, "Misc. Info": string, "Pointer to Device Data Header": u32, "Number of Reserved Bytes": i32}
  "Characterization Data.gtype" = cluster{"Gains[dB]": f64[], "Frequencies [Hz]": f64[], "IQ Imbalance Table": "IQ Imbalance.gtype"[], "Measured Gains[dB]": f64[][]}
  "niUsrpRio Session.gtype" = cluster{"FPGA Interface": any, "RIO Interface Number": u32, "Data Clock Rate": u32, "FPGA Data Clock Rate": u32, "Global Settings Register Bus": "Register Bus Session.gtype", "Radio 0 Settings Register Bus": "Register Bus Session.gtype", "Radio 1 Settings Register Bus": "Register Bus Session.gtype", "Radio Settings Bus Semaphore": "Semaphore.gtype", "DB Queues": "DB Queue Reference.gtype"[], "Characterization Data Valid?": bool, "EEPROM Header": "EEPROM Header.gtype", "Device Data Header": "EEPROM Device Data Header.gtype", "EEPROM Characterization Header": "EEPROM Characterization Header.gtype", "Characterization Data": "Characterization Data.gtype"[], "FPGA Current Version": u32, "FPGA Oldest Compatible Version": u32, "Fixed Logic Current Version": u32, "Fixed Logic Oldest Compatible Version": u32, "FPGA Radio Settings Bus Current Version": u32, "FPGA Radio Settings Bus Oldest Compatible Version": u32, "FPGA Board Config Current Version": u32, "FPGA Board Config Oldest Compatible Version": u32, "Daughterboard Clock Rate": u32}
  T1 = cluster{"Firmware, Tx MAC": path, "Firmware, Duplexer": path, "TX Sample Rate": f64, "TX Antenna": string, "RX Antenna": string, "Frequency Shift": f64, "Frequency (Hz)": f64, "RX Scope": string, "TX Scope": string, "Reference Frequency Source": string, "RX Sample Rate": f64}
uses:
  NI::USRPRIO::ConfigV1Host::Open.gvi
  NI::USRPRIO::ConfigV1Host::Configure Clocks.gvi
  NI::USRPRIO::ConfigV1Host::Initialize Front End.gvi
  NI::USRPRIO::ConfigV1Host::Configure LO.gvi
  NI::USRPRIO::ConfigV1Host::Configure Active Antenna.gvi
  NI::USRPRIO::ConfigV1Host::Configure Gain.gvi
  NI::USRPRIO::ConfigV1Host::Enable Front End.gvi
diagram:
  Property Node(instance in=$"General Setting") -> ("TX Antenna"=w1, "RX Antenna"=w2, "Frequency (Hz)"=w3, "TX Scope"=w4, "RX Scope"=w5, "Reference Frequency Source"=w6, "Frequency Shift"=w7, "TX Sample Rate"=w8, "RX Sample Rate"=w9)
  FPGA Open Node(RIO address=$"RIO Add") -> (error out=w10, reference out=w11)
  FPGA Download Node(error in=w10, reference in=w11) -> (error out=w12, reference out=w13)
  FPGA Run Node(error in=w12, reference in=w13) -> (error out=w14, reference out=w15)
  call "Open.gvi"(fpga ref=w15, reset?=TRUE, error in=w14) -> (niusrprio session out=w16, error out=w17)
  call "Configure Clocks.gvi"(niusrprio session in=w16, reference frequency source=w6, gpsdo power enable=TRUE, timeout=1, error in=w17, scope=w5) -> (niusrprio session out=w18, error out=w19)
  call "Configure Clocks.gvi"(niusrprio session in=w18, reference frequency source=w6, gpsdo power enable=TRUE, timeout=1, error in=w19, scope=w4) -> (niusrprio session out=w20, error out=w21)
  call "Initialize Front End.gvi"(niusrprio session in=w20, error in=w21) -> (niusrprio session out=w22, error out=w23)
  call "Configure LO.gvi"(niusrprio session in=w22, frequency=w3, error in=w23, scope=w5) -> (niusrprio session out=w24, error out=w25)
  call "Configure LO.gvi"(niusrprio session in=w24, frequency=w3, error in=w25, scope=w4) -> (niusrprio session out=w26, error out=w27)
  call "Configure Active Antenna.gvi"(niusrprio session in=w26, active antenna=w2, error in=w27, scope=w5) -> (niusrprio session out=w28, error out=w29)
  call "Configure Active Antenna.gvi"(niusrprio session in=w28, active antenna=w1, error in=w29, scope=w4) -> (niusrprio session out=w30, error out=w31)
  call "Configure Gain.gvi"(niusrprio session in=w30, gain=10, error in=w31, scope=w5) -> (niusrprio session out=w32, error out=w33)
  call "Configure Gain.gvi"(niusrprio session in=w32, gain=0, error in=w33, scope=w4) -> (niusrprio session out=w34, error out=w35)
  call "Enable Front End.gvi"(niusrprio session in=w34, enable=TRUE, error in=w35, scope=w5) -> (niusrprio session out=w36, error out=w37)
  call "Enable Front End.gvi"(niusrprio session in=w36, enable=TRUE, error in=w37, scope=w4) -> (niusrprio session out=w38, error out=w39)
  call "ConfigTX.gvi"(PHY Source=$"PHY Source", niusrprio session=w38, Frequency=w3, Frequency shift=-10000043, Sample rate=119999997, error in=w39, FPGA Reference=$"FPGA Reference", Scope=w4) -> (niusrprio session out=w40, error out=w41)
  call "ConfigRX.gvi"(niusrprio session in=w40, Frequency=w3, Sample rate=119999997, error in=w41, FPGA Reference=$"FPGA Reference", Scope=w5) -> (niusrprio session out=w42, error out=w43)
  call "ConfigTX.gvi"(PHY Source=$"PHY Source", niusrprio session=w42, Frequency=999999997, Frequency shift=w7, Sample rate=w8, error in=w43, FPGA Reference=$"FPGA Reference", Scope=w4) -> (niusrprio session out=w44, error out=w45)
  Negate(x=w7) -> w46
  call "ConfigRX.gvi"(niusrprio session in=w44, Frequency=w3, Frequency shift=w46, Sample rate=w9, error in=w45, FPGA Reference=$"FPGA Reference", Scope=w5) -> (niusrprio session out=w47, error out=w48)
  call "Configure Gain.gvi"(niusrprio session in=w47, gain=$"RX Gain", error in=w48, scope=w5) -> (niusrprio session out=w49, coerced gain=w50, error out=w51)
  call "CalibrateLevel.gvi"(coerced gain=w50) -> (Numeric=w52)
  $"Calibration Factor" <- w52
  # To change the bit file:
  # 1- change the bit file in "Open FPGA VI" bock.
  # 2- Right click on "FPGA Reference" and select "Open G type". Then configure the G type.
  call "Configure Gain.gvi"(niusrprio session in=w49, gain=$"TX Gain", error in=w51, scope=w4) -> (niusrprio session out=w53, error out=w54)
  Property Node(instance in=w53) -> ("FPGA Interface"=w55, instance out=w56)
  $Session <- w56
  Dynamic Fpga Interface Cast(reference in=w55, type=$"FPGA Reference") -> (reference out=w57)
  $"FPGA Reference_out" <- w57
  $Error <- w54
