vi "Read Int32 From File.gvi"   [LabVIEW Communications System Design Suite 2.0.1]
inputs:
  "count": i32 = 65536
  "path": path
outputs:
  "Out Array": i16[]
diagram:
  Open Or Create Or Replace File(access (0:read/write)="read-only", file path (use dialog)=$path, operation (0:open)="open") -> (refnum out=w1)
  Read From Binary File(byte order="little-endian", count=$count, file (use dialog)=w1) -> (data=w2)
  Array Size(array=w2) -> (size(s)=w3)
  Divide(x=w3, y=2) -> w4
  for (N = w4) (iteration -> i1) {
    Multiply(i1, 2) -> w6
    Increment(x=w6) -> w7
    Array Index(array=w2) -> (out0[w6]=w8, out1[w7]=w9)
    Join Numbers(high(x)=w9, low(x)=w8) -> w10
    append w10 to w5
  }
  To Word Integer(number=w5) -> w11
  $"Out Array" <- w11
