vi "KUL DiSIC Tester_Host.gvi"   [LabVIEW NXG 4.0.0]
panel controls:
  "stop": bool
  "TX": bool
  "Tab": i32
  "RX Gain": f64
  "TX Gain": f64
  "nbSamples, Rx Baseband data IQ": u32 = 1000
  "General Setting": T1 = {"Firmware, Tx MAC"=path "C:\\Users\\shassani\\Desktop\\MY_IBFD\\Microblaze\\Workspace\\mbCSMA\\Debug\\mbCSMA.bin", "Firmware, Duplexer"=path "C:\\Users\\shassani\\Desktop\\MY_IBFD\\Microblaze\\Workspace\\mbImecDuplexer\\Debug\\mbImecDuplexer.bin", "TX Sample Rate"=16000000, "TX Antenna"="TX/RX", "RX Antenna"="RX2", "Frequency Shift"=-10000000, "Frequency (Hz)"=1750000000, "RX Scope"="rx/RF 1", "TX Scope"="tx/RF 0", "Reference Frequency Source"="Internal", "RX Sample Rate"=16000000}
  "RIO address": string = "RIO0"
  "KUL DiSIC offset Rx I": i16 = 127
  "KUL DiSIC offset Rx Q": i16 = 340
  "DC-remove feedback for DiSIC": bool
  "DC-Remove feedback gain": f64 = 0.02
  "DiSIC data collector Setting": T2
  "KUL DiSIC Setting": T3
  "Data Collector SR": UFXP(1.47) = 0.833333333333
panel indicators:
  "Sig Power_For DiSIC": f64
  "DiSIC Tx Rx Delay": i32
  "IQ Data": i16[][]
  "Graph_Rx Spectrum_3": T4
  "DC Gauge": i16
types:
  T1 = cluster{"Firmware, Tx MAC": path, "Firmware, Duplexer": path, "TX Sample Rate": f64, "TX Antenna": string, "RX Antenna": string, "Frequency Shift": f64, "Frequency (Hz)": f64, "RX Scope": string, "TX Scope": string, "Reference Frequency Source": string, "RX Sample Rate": f64}
  T2 = cluster{"Canceller on 120M?": bool, "x": u16, "Tx busy send Zero": bool}
  T3 = cluster{"Offset Q": i16, "Offset I": i16, "mu_in": FXP(0.28), "Update_Sample": u16, "Freez_coff": bool, "Update_coff": bool, " RST": bool}
  T4 = cluster{"f0": f64, "df": f64, "magnitude": f64[]}
uses:
  NI::Analysis::Operations::1D Cross Correlation (CDB).gvi
  NI::Analysis::Statistics::Mean (DBL).gvi
diagram:
  Get Component Directory() -> (Path=w1)
  Build Path(base path=w1, name or relative path="Host\\OFDM Modulation\\OFDMData.bin") -> (appended path=w2)
  Open Or Create Or Replace File(access (0:read/write)="read-only", file path (use dialog)=w2, operation (0:open)="open") -> (refnum out=w3)
  Read From Binary File(byte order="little-endian", count=1696, data type=u32 0, file (use dialog)=w3) -> (data=w4, refnum out=w5)
  Build Array(w4, w4, w4, w4, w4) -> w6
  w7 = T2 {"Canceller on 120M?"=FALSE, "x"=177, "Tx busy send Zero"=FALSE}
  w8 = T3 {"Offset Q"=0, "Offset I"=0, "mu_in"=0.0080000013113, "Update_Sample"=256, "Freez_coff"=FALSE, "Update_coff"=FALSE, " RST"=TRUE}
  w9 = $"RIO address"
  sequence {
    frame 0 {
      $stop <- FALSE
      $TX <- FALSE
      $"DiSIC data collector Setting" <- w7
      $"KUL DiSIC Setting" <- w8
    }
  }
  Get Component Directory() -> (Path=w10)
  Strip Path(path=w10) -> (stripped path=w11)
  Property Node(instance in=$"General Setting", "Firmware, Tx MAC"=w11, "Firmware, Duplexer"=w11) -> (instance out=w12)
  call "InitUSRP.gvi"(TX Gain=$"TX Gain", RX Gain=$"RX Gain", RIO Add=w9, General Setting=w12) -> (FPGA Reference_out=w13, Calibration Factor=w14)
  sequence {
    frame 0 {
      Property Node(instance in=w13, "Write modulated data to memory"=TRUE) -> (instance out=w15)
      Wait(time to wait=100)
    }
    frame 1 {
      Host Fifo Write Node[FifoName="USRP Resources::USRP Resources.grsc::Modulated data from host"](data=w6, reference in=w15, timeout (ms)=10) -> (reference out=w16)
      Wait(time to wait=100)
    }
    frame 2 {
      Property Node(instance in=w16, "Write modulated data to memory"=FALSE) -> (instance out=w17)
      Wait(time to wait=500)
    }
  }
  s1 = 0  # shift register
  s2 = 0  # shift register
  while {
    # Measure delay and DC correction for DiSIC
    Host Fifo Read Node[FifoName="USRP Resources::USRP Resources.grsc::dx to host"](number of elements=0, reference in=w17, timeout (ms)=5) -> (elements remaining=w18, reference out=w19)
    Host Fifo Read Node[FifoName="USRP Resources::USRP Resources.grsc::dx to host"](number of elements=w18, reference in=w19, timeout (ms)=5) -> (data=w20)
    Array Size(array=w20) -> (size(s)=w21)
    Is Not Equal To 0(x=w21) -> w22
    Split Number(x=w20) -> (high(x)=w23, low(x)=w24)
    Split Number(x=w23) -> (high(x)=w25, low(x)=w26)
    Reinterpret Number[RestrictToSameWordLength=True](data in=w26) -> (data out=w27: i16[])
    Reinterpret Number[RestrictToSameWordLength=True](data in=w25) -> (data out=w28: i16[])
    Split Number(x=w24) -> (high(x)=w29, low(x)=w30)
    Reinterpret Number[RestrictToSameWordLength=True](data in=w30) -> (data out=w31: i16[])
    Reinterpret Number[RestrictToSameWordLength=True](data in=w29) -> (data out=w32: i16[])
    Real And Imaginary To Complex(x=w31, y=w32) -> w33
    Real And Imaginary To Complex(x=w27, y=w28) -> w34
    case (w22) {
      frame False, Default {
        w35 = 0
        w36 = c128[] []
        w37 = 0
      }
      frame True {
        call "1D Cross Correlation (CDB).gvi"(x=w33, y=w34, algorithm="frequency domain", normalization="none") -> (Rxy=w36)
        call "Mean (DBL).gvi"(x=w27) -> (mean=w35)
        call "Mean (DBL).gvi"(x=w28) -> (mean=w37)
      }
    }
    Absolute Value(x=w36) -> w38
    Array Max And Min(array=w38) -> (max index(es)=w39)
    Increment(x=w39) -> w40
    Subtract(x=w40, y=w21) -> w41: i32
    $"DiSIC Tx Rx Delay" <- w41
    Multiply(s2, 0.95) -> w42
    Multiply(w35, 0.05) -> w43
    Add(w42, w43) -> w44
    To Signed 16 Bit Integer(number=w44) -> w45
    Multiply(0.95, s1) -> w46
    Multiply(0.05, w37) -> w47
    Add(w47, w46) -> w48
    To Signed 16 Bit Integer(number=w48) -> w49
    Not(x=$"DC-remove feedback for DiSIC") -> w50
    case (w50) {
      frame False, Default {
        Add(w45, w49) -> w52
        $"DC Gauge" <- w52
        Real And Imaginary To Complex(x=w45, y=w49) -> w51
      }
      frame True {
        w51 = 0+0i
      }
    }
    Feedback Node(initial value=0+0i, input=w53) -> w54
    case ($"DC-remove feedback for DiSIC") {
      frame False, Default {
        w53 = 0+0i
        w55 = $"KUL DiSIC offset Rx I"
        w56 = $"KUL DiSIC offset Rx Q"
      }
      frame True {
        Multiply(w51, $"DC-Remove feedback gain") -> w57
        Add(w57, w54) -> w53
        Complex To Real And Imaginary(x + iy=w53) -> (x=w58, y=w59)
        To Signed 16 Bit Integer(number=w58) -> w55
        To Signed 16 Bit Integer(number=w59) -> w56
      }
    }
    $"KUL DiSIC offset Rx I" <- w55
    $"KUL DiSIC offset Rx Q" <- w56
    next s1 = w48
    next s2 = w44
    stop if $stop
  }
  while {
    # DiSIC settings
    Property Node(instance in=$"KUL DiSIC Setting", "Offset Q"=$"KUL DiSIC offset Rx Q", "Offset I"=$"KUL DiSIC offset Rx I") -> (instance out=w60)
    Property Node(instance in=w17, "DiSIC data collector Setting"=$"DiSIC data collector Setting", "KUL DiSIC Setting"=w60, "TransmiteData"=$TX, "Data Collector SR"=$"Data Collector SR")
    Wait(time to wait=100)
    stop if $stop
  }
  while {
    Is Equal(x=$Tab, y="Analog Duplexer") -> w61
    Is Equal(x=$Tab, y="PHY") -> w62
    Is Equal(x=$Tab, y="DiSIC") -> w63
    Logical Or(w61, w62, w63) -> w64
    case (w64) {
      frame False, Default { }
      frame True {
        Host Fifo Read Node[FifoName="USRP Resources::USRP Resources.grsc::RX_data"](number of elements=$"nbSamples, Rx Baseband data IQ", reference in=w17, timeout (ms)=10) -> (data=w65)
        # Plot PSD
        call "Power Spectrum.gvi"(N=$"nbSamples, Rx Baseband data IQ", data IQ=w65, Calibration=w14) -> (Inband power=w66, Spectrum=w67)
        $"Sig Power_For DiSIC" <- w66
        Property Node(instance in=T4 {"f0"=-8000000, "df"=16000, "magnitude"=[]}, "magnitude"=w67) -> (instance out=w68)
        $"Graph_Rx Spectrum_3" <- w68
        Split Number(x=w65) -> (high(x)=w69, low(x)=w70)
        To Signed 16 Bit Integer(number=w69) -> w71
        To Signed 16 Bit Integer(number=w70) -> w72
        Build Array(w71, w72) -> w73
        $"IQ Data" <- w73
      }
    }
    Wait(time to wait=20)
    stop if $stop
  }
  Close File(refnum=w5)
