vi "Calculate Sample Rate.gvi"   [LabVIEW NXG]
inputs:
  "niUsrpRio Session": T7 = {"EEPROM Header"={"Number of Reserved Bytes"=9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}, "Device Data Header"={"Number of Reserved Bytes"=27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}, "EEPROM Characterization Header"={"Number of Reserved Bytes"=28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}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}
  "sample rate [S/s]": f64 = 10000000
  "error in": error
outputs:
  "niUsrpRio Session (out)": T7
  "sample rate [ratio]": f64
  "error out": error
types:
  T1 = cluster{"fpga ref": any, "bus instance": u32, "instruction FIFO depth": u32, "executing on FPGA target": bool, "show error call chain": bool}
  T2 = cluster{"Checksum": u32, "Product Code": u16, "Hardware Current Version": u16, "Hardware Oldest Compatible Version": u16, "EEPROM Map Current Version": u16, "EEPROM Map Oldest Compatible Version": u16, "User Password": string, "Pointer to Factory Header": u32, "Pointer to User Header": u32, "Recommended Interval": u16, "Number of Reserved Bytes": i32, "Number of Daughterboards": u8, "Daughterboard IDs": u16[], "Daughterboard Serial Numbers": string[]}
  T3 = cluster{"Checksum": u32, "Number of Channels": u8, "Number of Gain Settings": u16[], "Pointer to Characterization Data": u32[], "Number of Reserved Bytes": i32, "Number of Frequencies": u16[]}
  T4 = cluster{"Checksum": u32, "Date": timestamp, "Temperature": f32, "Misc. Info": string, "Pointer to Device Data Header": u32, "Number of Reserved Bytes": i32}
  T5 = cluster{"Gain Imbalance [linear]": f64, "Phase Imbalance [radians]": f64, "Offset": c128}
  T6 = cluster{"Gains[dB]": f64[], "Frequencies [Hz]": f64[], "IQ Imbalance Table": T5[], "Measured Gains[dB]": f64[][]}
  T7 = cluster{"Global Settings Register Bus": Queue<T1>, "Radio 0 Settings Register Bus": Queue<T1>, "Rx NI-USRP session": niUSRP, "Tx NI-USRP session": niUSRP, "FPGA Interface": any, "RIO Interface Number": u32, "EEPROM Header": T2, "Device Data Header": T3, "EEPROM Characterization Header": T4, "Characterization Data": T6[], "Characterization Data Valid?": bool, "Radio 1 Settings Register Bus": Queue<T1>, "Radio Settings Bus Semaphore": i32, "FPGA Current Version": u32, "FPGA Oldest Compatible Version": u32, "Fixed Logic Current Version": u32, "Fixed Logic Oldest Compatible Version": u32, "FPGA Radio Settings Bus Current Version": u32, "FPGA Radio Settings Bus Oldest Compatible Version": u32}
diagram:
  In Range And Coerce[IncludeHighLimit=True](lower limit=1831.1, upper limit=120000000, x=$"sample rate [S/s]") -> (In Range?=w1, coerced(x)=w2)
  call "Error Cluster From Error Code.gvi"(error code (0)=0, error message ("")="0: No Error", show call chain? (False)=TRUE, is warning? (False)=FALSE) -> (error out=w3)
  w4 = "-1: The requested sample rate (%#.3pS/s) is out-of-range for the %s.  Valid sample rate values are from %#.3pS/s to %#.3pS/s. For more information, see the context help for the DSP interpolation/decimation VIs on the FPGA."
  Format Into String(formatString=w4, $"sample rate [S/s]", "USRP-294x, USRP-295x, and USRP X3xx", 1831.1, 120000000) -> w5
  call "Error Cluster From Error Code.gvi"(error code (0)=-1, error message ("")=w5, show call chain? (False)=TRUE, is warning? (False)=FALSE) -> (error out=w6)
  Select(s=w1, t=w3, f=w6) -> w7
  Merge Errors($"error in", w7) -> (error out=w8)
  $"error out" <- w8
  Divide(x=w2, y=120000000) -> w9
  $"sample rate [ratio]" <- w9
  $"niUsrpRio Session (out)" <- $"niUsrpRio Session"
