vi "ConfigTX.gvi"   [LabVIEW NXG 4.0.0]
inputs:
  "niusrprio session": "niUsrpRio Session.gtype"
  "FPGA Reference": "FPGA Reference.gtype"
  "Sample rate": f64
  "Frequency shift": f64
  "Frequency": f64
  "PHY Source": u8
  "error in": error
  "Scope": string
outputs:
  "niusrprio session out": "niUsrpRio Session.gtype"
  "error out": error
panel controls:
  "PHYparameters": T3 = {0, 0, 0, 0, "0x1FFFF", "0x1FFFF", 0, 0, 0, 0, 0, 0, "0x200000", "0x200000"}
types:
  "Register Bus Session.gtype" = Queue<"Session Data.gtype">
  "Semaphore.gtype" = i32
  "DB Queue Reference.gtype" = Queue<"Daughterboard Data.gtype">
  "EEPROM Header.gtype" = cluster{"Checksum": u32, "Product Code": u16, "Hardware Current Version": u16, "Hardware Oldest Compatible Version": u16, "EEPROM Map Current Version": u16, "EEPROM Map Oldest Compatible Version": u16, "User Password": string, "Pointer to Factory Header": u32, "Pointer to User Header": u32, "Recommended Interval": u16, "Number of Reserved Bytes": i32, "Number of Daughterboards": u8, "Daughterboard IDs": u16[], "Daughterboard Serial Numbers": string[]}
  "EEPROM Device Data Header.gtype" = cluster{"Checksum": u32, "Number of Channels": u8, "Number of Gain Settings": u16[], "Pointer to Characterization Data": u32[], "Number of Reserved Bytes": i32, "Number of Frequencies": u16[]}
  "EEPROM Characterization Header.gtype" = cluster{"Checksum": u32, "Date": timestamp, "Temperature": f32, "Misc. Info": string, "Pointer to Device Data Header": u32, "Number of Reserved Bytes": i32}
  "Characterization Data.gtype" = cluster{"Gains[dB]": f64[], "Frequencies [Hz]": f64[], "IQ Imbalance Table": "IQ Imbalance.gtype"[], "Measured Gains[dB]": f64[][]}
  "niUsrpRio Session.gtype" = cluster{"FPGA Interface": any, "RIO Interface Number": u32, "Data Clock Rate": u32, "FPGA Data Clock Rate": u32, "Global Settings Register Bus": "Register Bus Session.gtype", "Radio 0 Settings Register Bus": "Register Bus Session.gtype", "Radio 1 Settings Register Bus": "Register Bus Session.gtype", "Radio Settings Bus Semaphore": "Semaphore.gtype", "DB Queues": "DB Queue Reference.gtype"[], "Characterization Data Valid?": bool, "EEPROM Header": "EEPROM Header.gtype", "Device Data Header": "EEPROM Device Data Header.gtype", "EEPROM Characterization Header": "EEPROM Characterization Header.gtype", "Characterization Data": "Characterization Data.gtype"[], "FPGA Current Version": u32, "FPGA Oldest Compatible Version": u32, "Fixed Logic Current Version": u32, "Fixed Logic Oldest Compatible Version": u32, "FPGA Radio Settings Bus Current Version": u32, "FPGA Radio Settings Bus Oldest Compatible Version": u32, "FPGA Board Config Current Version": u32, "FPGA Board Config Oldest Compatible Version": u32, "Daughterboard Clock Rate": u32}
  T1 = cluster{"inline gain I": FXP(1.17), "inline gain Q": FXP(1.17), "cross gain I": FXP(1.17), "cross gain Q": FXP(1.17), "pre-gain offset I": FXP(1.17), "pre-gain offset Q": FXP(1.17), "post-gain offset I": FXP(1.17), "post-gain offset Q": FXP(1.17)}
  T2 = cluster{"gain I": FXP(3.21), "gain Q": FXP(3.21)}
  T3 = cluster{"delay": FXP(0.18), "input sample rate": UFXP(1.47), "frequency shift": FXP(0.48), "phase": FXP(0.21), "impairments": T1, "gain": T2}
diagram:
  Property Node(instance in=$"niusrprio session") -> ("FPGA Interface"=w1)
  Dynamic Fpga Interface Cast(reference in=w1, type=$"FPGA Reference") -> (reference out=w2)
  w3 = T1 {"inline gain I"=0.999992370605, "inline gain Q"=0.999992370605, "cross gain I"=0, "cross gain Q"=0, "pre-gain offset I"=0.999992370605, "pre-gain offset Q"=0.999992370605, "post-gain offset I"=0, "post-gain offset Q"=0}
  To Lower Case(string=$Scope) -> w4
  case (w4) {
    frame "tx/RF 1" {
      w5 = 3
      w6 = "TX"
    }
    frame "rx/RF 0" {
      w5 = 0
      w6 = "RX"
    }
    frame "rx/RF 1" {
      w5 = 2
      w6 = "RX"
    }
    frame "tx/RF 0", Default {
      w5 = 1
      w6 = "TX"
    }
  }
  Property Node(instance in=$"niusrprio session") -> ("Characterization Data"=w7)
  Array Index(array=w7) -> (out0[w5]=w8)
  Property Node(instance in=w8) -> ("IQ Imbalance Table"=w9, "Frequencies [Hz]"=w10)
  for {
    w11 = each element of w9
    Property Node(instance in=w11) -> ("Gain Imbalance [linear]"=w16, "Phase Imbalance [radians]"=w17, "Offset"=w18)
    Complex To Real And Imaginary(x + iy=w18) -> (x=w19, y=w20)
    append w16 to w12
    append w17 to w13
    append w19 to w14
    append w20 to w15
  }
  Threshold 1D Array(array of numbers or points=w10, threshold y=$Frequency) -> w21
  Interpolate 1D Array(array of numbers or points=w12, fractional index or x=w21) -> w22
  Interpolate 1D Array(array of numbers or points=w13, fractional index or x=w21) -> w23
  Cosine(x=w23) -> w24
  Multiply(w22, w24) -> w25
  Reciprocal(x=w25) -> w26
  Tangent(x=w23) -> w27
  Negate(x=w27) -> w28
  Is Greater(x=w26, y=1) -> w29
  case (w29) {
    frame False, Default {
      Reciprocal(x=w26) -> w32
      Divide(x=w28, y=w26) -> w31
      w30 = 1
    }
    frame True {
      w30 = w26
      w31 = w28
      w32 = 1
    }
  }
  To Fixed Point(number=w32) -> w33: FXP(1.17) Saturate:ConvergentRounding
  To Fixed Point(number=w30) -> w34: FXP(1.17) Saturate:ConvergentRounding
  To Fixed Point(number=w31) -> w35: FXP(1.17) Saturate:ConvergentRounding
  To Fixed Point(number=0) -> w36: FXP(1.17) Saturate:ConvergentRounding
  Interpolate 1D Array(array of numbers or points=w14, fractional index or x=w21) -> w37
  Interpolate 1D Array(array of numbers or points=w15, fractional index or x=w21) -> w38
  case (w6) {
    frame "RX", Default {
      Negate(x=w37) -> w39
      Negate(x=w38) -> w42
      w40 = 0
      w41 = 0
    }
    frame "TX" {
      Negate(x=w37) -> w40
      Negate(x=w38) -> w41
      w39 = 0
      w42 = 0
    }
  }
  To Fixed Point(number=w39) -> w43: FXP(1.17) Saturate:ConvergentRounding
  To Fixed Point(number=w42) -> w44: FXP(1.17) Saturate:ConvergentRounding
  To Fixed Point(number=w40) -> w45: FXP(1.17) Saturate:ConvergentRounding
  To Fixed Point(number=w41) -> w46: FXP(1.17) Saturate:ConvergentRounding
  Property Node(instance in=w3, "inline gain I"=w33, "inline gain Q"=w34, "cross gain I"=w35, "cross gain Q"=w36, "pre-gain offset I"=w43, "pre-gain offset Q"=w44, "post-gain offset I"=w45, "post-gain offset Q"=w46) -> (instance out=w47)
  Reciprocal(x=w32) -> w48
  Property Node(instance in=T2 {"gain I"=1, "gain Q"=1}, "gain I"=w48, "gain Q"=w48) -> (instance out=w49)
  In Range And Coerce(lower limit=1831.1, upper limit=120000000, x=$"Sample rate") -> (coerced(x)=w50)
  Divide(x=w50, y=120000000) -> w51
  To Fixed Point(number=w51) -> w52: UFXP(1.47) Saturate:ConvergentRounding
  Divide(x=$"Frequency shift", y=120000000) -> w53
  To Fixed Point(number=w53) -> w54: FXP(0.48) Saturate:ConvergentRounding
  Property Node(instance in=$PHYparameters, "input sample rate"=w52, "frequency shift"=w54, "impairments"=w47, "gain"=w49) -> (instance out=w55)
  Property Node(instance in=w2, "PHYparameters"=w55, error in=$"error in") -> (error out=w56)
  $"error out" <- w56
  $"niusrprio session out" <- $"niusrprio session"
