vi "Configure Frequency Shift.gvi"   [LabVIEW NXG]
inputs:
  "niUsrpRio session": T7
  "clock rate": f64 = 120000000
  "frequency shift": f64
  "error in": error
  "scope": string = "rx"
outputs:
  "niUsrpRio Session (out)": T7
  "error out": error
panel controls:
  "ConstantData2": any
types:
  T1 = cluster{"fpga ref": any, "bus instance": u32, "instruction FIFO depth": u32, "executing on FPGA target": bool, "show error call chain": bool}
  T2 = cluster{"Checksum": u32, "Product Code": u16, "Hardware Current Version": u16, "Hardware Oldest Compatible Version": u16, "EEPROM Map Current Version": u16, "EEPROM Map Oldest Compatible Version": u16, "User Password": string, "Pointer to Factory Header": u32, "Pointer to User Header": u32, "Recommended Interval": u16, "Number of Reserved Bytes": i32, "Number of Daughterboards": u8, "Daughterboard IDs": u16[], "Daughterboard Serial Numbers": string[]}
  T3 = cluster{"Checksum": u32, "Number of Channels": u8, "Number of Gain Settings": u16[], "Pointer to Characterization Data": u32[], "Number of Reserved Bytes": i32, "Number of Frequencies": u16[]}
  T4 = cluster{"Checksum": u32, "Date": timestamp, "Temperature": f32, "Misc. Info": string, "Pointer to Device Data Header": u32, "Number of Reserved Bytes": i32}
  T5 = cluster{"Gain Imbalance [linear]": f64, "Phase Imbalance [radians]": f64, "Offset": c128}
  T6 = cluster{"Gains[dB]": f64[], "Frequencies [Hz]": f64[], "IQ Imbalance Table": T5[], "Measured Gains[dB]": f64[][]}
  T7 = cluster{"Global Settings Register Bus": Queue<T1>, "Radio 0 Settings Register Bus": Queue<T1>, "Rx NI-USRP session": niUSRP, "Tx NI-USRP session": niUSRP, "FPGA Interface": any, "RIO Interface Number": u32, "EEPROM Header": T2, "Device Data Header": T3, "EEPROM Characterization Header": T4, "Characterization Data": T6[], "Characterization Data Valid?": bool, "Radio 1 Settings Register Bus": Queue<T1>, "Radio Settings Bus Semaphore": i32, "FPGA Current Version": u32, "FPGA Oldest Compatible Version": u32, "Fixed Logic Current Version": u32, "Fixed Logic Oldest Compatible Version": u32, "FPGA Radio Settings Bus Current Version": u32, "FPGA Radio Settings Bus Oldest Compatible Version": u32}
diagram:
  call "niUsrpRio Config v1 Host.lvlib__Parse Scope.gvi"(niUsrpRio Session=$"niUsrpRio session", Error In=$"error in", scope=$scope) -> (niUsrpRio Session (out)=w1, Device Subfunction=w2, Device Subfunction Channel=w3, Error Out=w4)
  $"niUsrpRio Session (out)" <- w1
  Property Node(instance in=w1) -> ("FPGA Interface"=w5)
  Dynamic Fpga Interface Cast(FPGA VI Reference In=w5, Type=$ConstantData2) -> (FPGA VI Reference Out=w6)
  Divide(x=$"frequency shift", y=$"clock rate") -> w7
  case (w2) {
    frame "rx", Default {
      Negate(x=w7) -> w9
      case (w3) {
        frame "1" {
          Property Node(instance in=w6, error in=w4, "rx 1.frequency shift"=w9) -> (error out=w8)
        }
        frame "0", Default {
          Property Node(instance in=w6, error in=w4, "rx 0.frequency shift"=w9) -> (error out=w8)
        }
      }
    }
    frame "tx" {
      case (w3) {
        frame "0", Default {
          Property Node(instance in=w6, error in=w4, "tx 0.frequency shift"=w7) -> (error out=w8)
        }
        frame "1" {
          Property Node(instance in=w6, error in=w4, "tx 1.frequency shift"=w7) -> (error out=w8)
        }
      }
    }
  }
  $"error out" <- w8
