vi "Configure Signal (Common).gvi"   [LabVIEW NXG]
inputs:
  "niUsrpRio Session": T7 = {"EEPROM Header"={"Number of Reserved Bytes"=9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}, "Device Data Header"={"Number of Reserved Bytes"=27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}, "EEPROM Characterization Header"={"Number of Reserved Bytes"=28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}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}
  "signal parameters": T8 = {"gain/level"=0, "sample rate [S/s]"=10000000, "frequency [Hz]"=2450000000, "LO frequency [Hz]"=-1, "active antenna"="RX1"}
  "Configure Signal Mode": enum{"Gain", "Level"} = "Gain"
  "error in": error
  "scope": string = "rx"
  "Correct Impairments?": bool = TRUE
outputs:
  "niUsrpRio Session (out)": T7
  "coerced signal parameters": T8
  "error out": error
panel controls:
  "ConstantData4": any
types:
  T1 = cluster{"fpga ref": any, "bus instance": u32, "instruction FIFO depth": u32, "executing on FPGA target": bool, "show error call chain": bool}
  T2 = cluster{"Checksum": u32, "Product Code": u16, "Hardware Current Version": u16, "Hardware Oldest Compatible Version": u16, "EEPROM Map Current Version": u16, "EEPROM Map Oldest Compatible Version": u16, "User Password": string, "Pointer to Factory Header": u32, "Pointer to User Header": u32, "Recommended Interval": u16, "Number of Reserved Bytes": i32, "Number of Daughterboards": u8, "Daughterboard IDs": u16[], "Daughterboard Serial Numbers": string[]}
  T3 = cluster{"Checksum": u32, "Number of Channels": u8, "Number of Gain Settings": u16[], "Pointer to Characterization Data": u32[], "Number of Reserved Bytes": i32, "Number of Frequencies": u16[]}
  T4 = cluster{"Checksum": u32, "Date": timestamp, "Temperature": f32, "Misc. Info": string, "Pointer to Device Data Header": u32, "Number of Reserved Bytes": i32}
  T5 = cluster{"Gain Imbalance [linear]": f64, "Phase Imbalance [radians]": f64, "Offset": c128}
  T6 = cluster{"Gains[dB]": f64[], "Frequencies [Hz]": f64[], "IQ Imbalance Table": T5[], "Measured Gains[dB]": f64[][]}
  T7 = cluster{"Global Settings Register Bus": Queue<T1>, "Radio 0 Settings Register Bus": Queue<T1>, "Rx NI-USRP session": niUSRP, "Tx NI-USRP session": niUSRP, "FPGA Interface": any, "RIO Interface Number": u32, "EEPROM Header": T2, "Device Data Header": T3, "EEPROM Characterization Header": T4, "Characterization Data": T6[], "Characterization Data Valid?": bool, "Radio 1 Settings Register Bus": Queue<T1>, "Radio Settings Bus Semaphore": i32, "FPGA Current Version": u32, "FPGA Oldest Compatible Version": u32, "Fixed Logic Current Version": u32, "Fixed Logic Oldest Compatible Version": u32, "FPGA Radio Settings Bus Current Version": u32, "FPGA Radio Settings Bus Oldest Compatible Version": u32}
  T8 = cluster{"gain/level": f64, "sample rate [S/s]": f64, "frequency [Hz]": f64, "LO frequency [Hz]": f64, "active antenna": string}
  T9 = cluster{"inline gain I": FXP(1.17), "inline gain Q": FXP(1.17), "cross gain I": FXP(1.17), "cross gain Q": FXP(1.17), "pre-gain offset I": FXP(1.17), "pre-gain offset Q": FXP(1.17), "post-gain offset I": FXP(1.17), "post-gain offset Q": FXP(1.17)}
  T10 = cluster{"gain I": FXP(3.21), "gain Q": FXP(3.21)}
diagram:
  Property Node(instance in=$"signal parameters") -> ("LO frequency [Hz]"=w1, "frequency [Hz]"=w2, "active antenna"=w3, "gain/level"=w4, "sample rate [S/s]"=w5)
  call "Configure Frequency.gvi"(niUsrpRio Session=$"niUsrpRio Session", wait for lo to lock=TRUE, lo frequency=w1, frequency=w2, error in=$"error in", scope=$scope) -> (niUsrpRio Session (out)=w6, coerced lo frequency=w7, error out=w8)
  call "niUsrpRio Config v1 Host.lvlib__Configure Active Antenna.gvi"(niUsrpRio session=w6, active antenna=w3, Error In=w8, scope=$scope) -> (niUsrpRio session (out)=w9, coerced active antenna=w10, Error Out=w11)
  case ($"Configure Signal Mode") {
    frame "Gain", Default {
      w12 = w9
      w13 = w7
      w14 = w11
      w15 = w4
      w16 = w4
    }
    frame "Level" {
      call "niUsrpRio Config v1 Host.lvlib__Calculate Level Range.gvi"(niUsrpRio Session=w9, frequency=w7, error in=w11, scope=$scope) -> (niUsrpRio Session (out)=w17, Min Level=w18, Max Level=w19, error out=w20)
      In Range And Coerce[IncludeHighLimit=True](lower limit=w18, upper limit=w19, x=w4) -> (coerced(x)=w16)
      call "niUsrpRio Config v1 Host.lvlib__Calculate Gain Setting.gvi"(niUsrpRio Session=w17, level=w16, frequency=w7, error in=w20, scope=$scope) -> (niUsrpRio Session (out)=w12, gain=w15, error out=w14)
      w13 = w7
    }
  }
  call "niUsrpRio Config v1 Host.lvlib__Configure Gain.gvi"(niUsrpRio session=w12, gain=w15, Error In=w14, scope=$scope) -> (niUsrpRio session (out)=w21, coerced gain=w22, Error Out=w23)
  case ($"Correct Impairments?") {
    frame False, Default {
      w28 = T9 {"inline gain I"=0.999992370605, "inline gain Q"=0.999992370605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}
      Property Node(instance in=w28) -> ("inline gain I"=w29)
      To Double Precision Float(number=w29) -> w27
      w24 = w21
      w25 = w23
      w26 = w28
    }
    frame True {
      call "niUsrpRio Config v1 Host.lvlib__Calculate IQ Imbalance Correction.gvi"(niUsrpRio Session=w21, frequency=w13, error in=w23, scope=$scope) -> (niUsrpRio Session (out)=w24, IQ imbalance correction=w26, correction gain=w27, error out=w25)
    }
  }
  call "Calculate Sample Rate.gvi"(niUsrpRio Session=w24, sample rate [S/s]=w5, error in=w25) -> (niUsrpRio Session (out)=w30, sample rate [ratio]=w31, error out=w32)
  call "niUsrpRio Config v1 Host.lvlib__Parse Scope.gvi"(niUsrpRio Session=w30, Error In=w32, scope=$scope) -> (niUsrpRio Session (out)=w33, Device Subfunction=w34, Device Subfunction Channel=w35, Error Out=w36)
  Property Node(instance in=w33) -> ("FPGA Interface"=w37)
  Dynamic Fpga Interface Cast(FPGA VI Reference In=w37, Type=$ConstantData4) -> (FPGA VI Reference Out=w38)
  case (w34) {
    frame "rx", Default {
      case (w35) {
        frame "0", Default {
          Property Node(instance in=w38, error in=w36, "rx.output sample rate"=w31, "rx 0.impairments"=w26) -> (error out=w39)
        }
        frame "1" {
          Property Node(instance in=w38, error in=w36, "rx.output sample rate"=w31, "rx 1.impairments"=w26) -> (error out=w39)
        }
      }
      Logarithm Base 10(x=w27) -> w41
      Multiply(w41, 20) -> w42
      case ($"Configure Signal Mode") {
        frame "Gain", Default {
          Add(w42, w22) -> w40
        }
        frame "Level" {
          Subtract(x=w22, y=w15) -> w43
          Add(w42, w43) -> w44
          Subtract(x=w16, y=w44) -> w40
        }
      }
    }
    frame "tx" {
      Reciprocal(x=w27) -> w45
      Property Node(instance in=T10 {"gain I"=1, "gain Q"=1}, "gain I"=w45, "gain Q"=w45) -> (instance out=w46)
      Absolute Value(x=w45) -> w47
      Is Greater(x=w47, y=4) -> w48
      case (w48) {
        frame False, Default {
          w49 = no error
        }
        frame True {
          w50 = "5006: Requested correction exceeds gain range of onboard DSP."
          call "Error Cluster From Error Code.gvi"(error code (0)=5006, error message ("")=w50, show call chain? (False)=TRUE, is warning? (False)=FALSE) -> (error out=w49)
        }
      }
      Merge Errors(w36, w49) -> (error out=w51)
      case (w35) {
        frame "1" {
          Property Node(instance in=w38, error in=w51, "tx.input sample rate"=w31, "tx 1.impairments"=w26, "tx 1.gain"=w46) -> (error out=w39)
        }
        frame "0", Default {
          Property Node(instance in=w38, error in=w51, "tx.input sample rate"=w31, "tx 0.impairments"=w26, "tx 0.gain"=w46) -> (error out=w39)
        }
      }
      case ($"Configure Signal Mode") {
        frame "Gain", Default {
          w40 = w22
        }
        frame "Level" {
          Subtract(x=w22, y=w15) -> w52
          Add(w52, w16) -> w40
        }
      }
    }
  }
  $"error out" <- w39
  $"niUsrpRio Session (out)" <- w33
  w53 = T8 {"gain/level"=0, "sample rate [S/s]"=10000000, "frequency [Hz]"=2450000000, "LO frequency [Hz]"=-1, "active antenna"="RX1"}
  Property Node(instance in=w53, "gain/level"=w40, "LO frequency [Hz]"=w7, "frequency [Hz]"=w2, "sample rate [S/s]"=w5, "active antenna"=w10) -> (instance out=w54)
  $"coerced signal parameters" <- w54
