vi "Fetch Rx Data (CDB WDT).gvi"   [LabVIEW NXG]
inputs:
  "niUsrpRio Session": T7 = {"EEPROM Header"={"Number of Reserved Bytes"=9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}, "Device Data Header"={"Number of Reserved Bytes"=27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}, "EEPROM Characterization Header"={"Number of Reserved Bytes"=28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}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}
  "number of samples": u32 = 8192
  "timeout": f64 = 10
  "error in": error
  "scope": string
  "vertical range [Vpp]": f64 = 2
  "sample rate": f64 = 10000000
  "leading samples to trim": u32
outputs:
  "niUsrpRio Session (out)": T7
  "Waveform (CDB WDT)": cluster{"t0": timestamp, "dt": f64, "Y": c128[]}
  "error out": error
types:
  T1 = cluster{"fpga ref": any, "bus instance": u32, "instruction FIFO depth": u32, "executing on FPGA target": bool, "show error call chain": bool}
  T2 = cluster{"Checksum": u32, "Product Code": u16, "Hardware Current Version": u16, "Hardware Oldest Compatible Version": u16, "EEPROM Map Current Version": u16, "EEPROM Map Oldest Compatible Version": u16, "User Password": string, "Pointer to Factory Header": u32, "Pointer to User Header": u32, "Recommended Interval": u16, "Number of Reserved Bytes": i32, "Number of Daughterboards": u8, "Daughterboard IDs": u16[], "Daughterboard Serial Numbers": string[]}
  T3 = cluster{"Checksum": u32, "Number of Channels": u8, "Number of Gain Settings": u16[], "Pointer to Characterization Data": u32[], "Number of Reserved Bytes": i32, "Number of Frequencies": u16[]}
  T4 = cluster{"Checksum": u32, "Date": timestamp, "Temperature": f32, "Misc. Info": string, "Pointer to Device Data Header": u32, "Number of Reserved Bytes": i32}
  T5 = cluster{"Gain Imbalance [linear]": f64, "Phase Imbalance [radians]": f64, "Offset": c128}
  T6 = cluster{"Gains[dB]": f64[], "Frequencies [Hz]": f64[], "IQ Imbalance Table": T5[], "Measured Gains[dB]": f64[][]}
  T7 = cluster{"Global Settings Register Bus": Queue<T1>, "Radio 0 Settings Register Bus": Queue<T1>, "Rx NI-USRP session": niUSRP, "Tx NI-USRP session": niUSRP, "FPGA Interface": any, "RIO Interface Number": u32, "EEPROM Header": T2, "Device Data Header": T3, "EEPROM Characterization Header": T4, "Characterization Data": T6[], "Characterization Data Valid?": bool, "Radio 1 Settings Register Bus": Queue<T1>, "Radio Settings Bus Semaphore": i32, "FPGA Current Version": u32, "FPGA Oldest Compatible Version": u32, "Fixed Logic Current Version": u32, "Fixed Logic Oldest Compatible Version": u32, "FPGA Radio Settings Bus Current Version": u32, "FPGA Radio Settings Bus Oldest Compatible Version": u32}
diagram:
  w1 = cluster{"t0": timestamp, "dt": f64, "Y": c128[]} {all zero or empty}
  call "Fetch Rx Data (U32).gvi"(niUsrpRio Session=$"niUsrpRio Session", number of samples=$"number of samples", timeout=$timeout, error in=$"error in", scope=$scope, vertical range [Vpp]=$"vertical range [Vpp]", leading samples to trim=$"leading samples to trim") -> (niUsrpRio Session (out)=w2, waveform data=w3, error out=w4, scaling (V/code)=w5)
  Split Number(x=w3) -> (high(x)=w6, low(x)=w7)
  Type Cast(type=i16[] [], x=w7) -> w8
  Multiply(w8, w5) -> w9
  Type Cast(type=i16[] [], x=w6) -> w10
  Multiply(w10, w5) -> w11
  Real And Imaginary To Complex(x=w9, y=w11) -> w12
  Reciprocal(x=$"sample rate") -> w13
  Property Node(instance in=w1, "Y"=w12, "dt"=w13) -> (instance out=w14)
  $"Waveform (CDB WDT)" <- w14
  $"niUsrpRio Session (out)" <- w2
  $"error out" <- w4
