vi "Open Device.gvi"   [LabVIEW NXG]
inputs:
  "USRP RIO device": string
  "error in": error
outputs:
  "niUsrpRio Session (out)": T7
  "error out": error
types:
  T1 = cluster{"fpga ref": any, "bus instance": u32, "instruction FIFO depth": u32, "executing on FPGA target": bool, "show error call chain": bool}
  T2 = cluster{"Checksum": u32, "Product Code": u16, "Hardware Current Version": u16, "Hardware Oldest Compatible Version": u16, "EEPROM Map Current Version": u16, "EEPROM Map Oldest Compatible Version": u16, "User Password": string, "Pointer to Factory Header": u32, "Pointer to User Header": u32, "Recommended Interval": u16, "Number of Reserved Bytes": i32, "Number of Daughterboards": u8, "Daughterboard IDs": u16[], "Daughterboard Serial Numbers": string[]}
  T3 = cluster{"Checksum": u32, "Number of Channels": u8, "Number of Gain Settings": u16[], "Pointer to Characterization Data": u32[], "Number of Reserved Bytes": i32, "Number of Frequencies": u16[]}
  T4 = cluster{"Checksum": u32, "Date": timestamp, "Temperature": f32, "Misc. Info": string, "Pointer to Device Data Header": u32, "Number of Reserved Bytes": i32}
  T5 = cluster{"Gain Imbalance [linear]": f64, "Phase Imbalance [radians]": f64, "Offset": c128}
  T6 = cluster{"Gains[dB]": f64[], "Frequencies [Hz]": f64[], "IQ Imbalance Table": T5[], "Measured Gains[dB]": f64[][]}
  T7 = cluster{"Global Settings Register Bus": Queue<T1>, "Radio 0 Settings Register Bus": Queue<T1>, "Rx NI-USRP session": niUSRP, "Tx NI-USRP session": niUSRP, "FPGA Interface": any, "RIO Interface Number": u32, "EEPROM Header": T2, "Device Data Header": T3, "EEPROM Characterization Header": T4, "Characterization Data": T6[], "Characterization Data Valid?": bool, "Radio 1 Settings Register Bus": Queue<T1>, "Radio Settings Bus Semaphore": i32, "FPGA Current Version": u32, "FPGA Oldest Compatible Version": u32, "Fixed Logic Current Version": u32, "Fixed Logic Oldest Compatible Version": u32, "FPGA Radio Settings Bus Current Version": u32, "FPGA Radio Settings Bus Oldest Compatible Version": u32}
diagram:
  FPGA Open Node[ProjectItem="NullTarget:niUsrpRio_Xcvr\\.lvbitx"](Error In=$"error in", RIO Address=$"USRP RIO device") -> (Error Out=w1, FPGA VI Reference Out=w2)  # Open FPGA VI
  w3 = TRUE  # Reset?
  call "niUsrpRio Config v1 Host.lvlib__Open.gvi"(fpga ref=w2, reset?=w3, Error In=w1) -> (niUsrpRio Session (out)=w4, Error Out=w5)
  w6 = FALSE  # Enabled?
  call "niUsrpRio Config v1 Host.lvlib__Enable Front End.gvi"(niUsrpRio Session=w4, enable=w6, error in=w5, scope="rx") -> (niUsrpRio Session (out)=w7, error out=w8)
  w9 = FALSE  # Enabled?
  call "niUsrpRio Config v1 Host.lvlib__Enable Front End.gvi"(niUsrpRio Session=w7, enable=w9, error in=w8, scope="tx") -> (niUsrpRio Session (out)=w10, error out=w11)
  $"niUsrpRio Session (out)" <- w10
  $"error out" <- w11
